# Grasshopper definition test.ghx (Grasshopper 1.0.7)

test = GhPythonScript()  # -> out
# ---------- test: Python ----------
__author__ = "trtku"
__version__ = "2021.11.28"

import imp
import test
imp.reload(test)

result = test.test()
print(result)
# ---------- end test ----------
