# Grasshopper definition 00_nested_list_basics.ghx (Grasshopper 1.0.7)
# plug-ins: Bifocals

# ----
# legend
# group of component
# input to change
# output to visuzlize
# data to pass
# copied from other file
# author: name: Ko Tsuruta
# copyright: © 2021 Ko Tsuruta
# email: trtku0809@gmail.com
# exercise
gallery = ImageGallery(
    CycleDelay=30,
    Randomize=False,
    UseLocalImages=True,
    UseRemoteImages=True,
    RemoteUrl="https://live.staticflickr.com/65535/51729808202_8bc46e4245_m.jpg")

# ----
# parameters
number_slider = Slider(5, range=1..10)
number_slider_2 = Slider(4, range=1..10)
number_slider_3 = Slider(3, range=1..10)
edge_length = Slider(1, range=0.1..10)

# ----
# base grid
_00_array_intro = GhPythonScript(arr1d_length=number_slider, arr2d_length=number_slider_2, arr3d_length=number_slider_3)  # -> out; inputs arr1d_length: Int32, arr2d_length: Int32, arr3d_length: Int32
# ---------- _00_array_intro: Python ----------
'''
ABOUT:
This is a file explaining about 1, 2 and 3 dimensional lists with for loop.
Strictly speaking, this is a 'nested-list', not an 'array' in terms of data type...
but I call it array to make it easy to learn numpy-array later.


SOURCE:
https://www.geeksforgeeks.org/difference-between-list-and-array-in-python/
https://medium.com/@z.arderne/numpy-array-vs-nested-list-622b95d12761


TIPS:
'.format()'
https://docs.python.org/3/tutorial/inputoutput.html#the-string-format-method

'\n (escape sequence)'
https://docs.python.org/3/reference/lexical_analysis.html#literals
'''



# 1d array

arr1d = []                           # Create an empty list____________________________________
for i in range(arr1d_length):        # Iterate through arr1d_length; i direction in this case  \
    arr1d.append(i)                  #     Append i into the list_______________________________} 1d array
print('\narr1d:\n{}'.format(arr1d))  # Print the list to check



# 2d array

arr2d = []                           # Create an empty list____________________________________________
for i in range(arr2d_length):        # Iterate through arr2d_length                                    \
    arr1d_temp = []                  #     Create a temporary empty list___________________             \
    for j in range(arr1d_length):    #     Iterate through arr1d_length                    \             \
        arr1d_temp.append(j)         #         Append j into the temporary list_____________} 1d array    } 2d array
    arr2d.append(arr1d_temp)         #     Append the temporary list into the parent list________________/
print('\narr2d:\n{}'.format(arr2d))  # Print the list to check



# 3d array

arr3d = []                             # create an empty list____________________________________________________________________
for i in range(arr3d_length):          # iterate through arr3d_length; z direction in this case                                  \
    arr2d_temp = []                    #     create a temporary empty list___________________________________________             \
    for j in range(arr2d_length):      #     jiterate through arr2d_length; y direction in this case                 \             \
        arr1d_temp = []                #         create a temporary empty list___________________________             \             \
        for k in range(arr1d_length):  #         iterate through arr1d_length; x direction in this case  \             \             \
            arr1d_temp.append(k)       #             append x into the list_______________________________} 1d array    } 2d array    } 3d array
        arr2d_temp.append(arr1d_temp)  #         append the list into the parent list__________________________________/             /
    arr3d.append(arr2d_temp)           #     append the list into the grand parent list_____________________________________________/
print('\narr3d\n{}'.format(arr3d))     # print the list to check



# equivallent using list comprehension



# arr1d
arr1d_comp = [i for i in range(arr1d_length)]
print('\narr1d and arr1d_comp are same: {}'.format(arr1d==arr1d_comp))



# arr2d
arr2d_comp = [[j for j in range(arr1d_length)] for i in range(arr2d_length)]
print('\narr2d and arr2d_comp are same: {}'.format(arr2d==arr2d_comp))



# arr3d
arr3d_comp = [[[k for k in range(arr1d_length)] for j in range(arr2d_length)] for i in range(arr3d_length)]
print('\narr3d and arr3d_comp are same: {}'.format(arr3d==arr3d_comp))
# ---------- end _00_array_intro ----------

# ----
# array with item
# base grid
_01_array_with_item = GhPythonScript(x_length=number_slider, y_length=number_slider_2, z_length=number_slider_3, edge_length=edge_length)  # -> out, arr1d, tag1d, arr2d, tag2d, arr3d, tag3d; inputs x_length: Int32, y_length: Int32, z_length: Int32
# ---------- _01_array_with_item: Python ----------
'''
ABOUT:
This is a file explaining about a difference between index and item
'''



# import module
import Rhino.Geometry as rg           # for geometrical operation using Rhino.Geometry namespace
import ghpythonlib.treehelpers as th  # for data transfer between python and grasshopper



# 1d array
print('\n----------1D ARRAY----------')
arr1d = []                                               # Create an empty list for point__________________________
tag1d = []                                               # Create an empty list for tag                            \
for i in range(x_length):                                # Iterate through x_length; x direction in this case       \
    grid_pt = rg.Point3d(i*edge_length, 0, 0)            #     Create a point                                        \
    text = '({},0,0)'.format(i)                          #     Create a string                                        } 1d array; x-dir
    arr1d.append(grid_pt)                                #     Append the point into the list; arr1d                 /
    tag1d.append(text)                                   #     Append the string into the list; tag1d               /
    print('\nindex: {}, \nitem: {}'.format(i, grid_pt))  #     Print the index and item to check___________________/



# 2d array
print('\n----------2D ARRAY----------')
arr2d = []                                                                       # Create an empty list for list of point__________________________________
tag2d = []                                                                       # Create an empty list for list of tag                                    \
for i in range(y_length):                                                        # Iterate through y_length; y direction in this case                       \
    temp_arr1d = []                                                              #     Create a temporary empty list for point                               \
    temp_tag1d = []                                                              #     Create a temporary empty list for tag                                  \
    for j in range(x_length):                                                    #     Iterate through x_length; x direction in this case__                    \
        grid_pt = rg.Point3d(j*edge_length, i*edge_length, 0)                    #         Create a point                                  \                    \
        text = '({},{},0)'.format(j, i)                                          #         Create a string                                  } 1d array; x-dir    } 2d array; y-dir
        temp_arr1d.append(grid_pt)                                               #         Append the point into the list; temp_arr1d      /                    /
        temp_tag1d.append(text)                                                  #         Append the string into the list; temp_tag1d    /                    /
        print('\nindex_x: {}, \nindex_y: {}, \nitem: {}'.format(j, i, grid_pt))  #         Print the index and item to check_____________/                    /
    arr2d.append(temp_arr1d)                                                     #     Append the temp_arr1d into the list; arr2d                            /
    tag2d.append(temp_tag1d)                                                     #     Append the temp_tag1d into the list; tag2d___________________________/



# 3d array
print('\n----------3D ARRAY----------')
arr3d = []                                                                                             # Create an empty list for list of list of point________________________________________________
tag3d = []                                                                                             # Create an empty list for list of list of tag                                                  \
for i in range(z_length):                                                                              # Iterate through z_length; z direction in this case                                             \
    temp_arr2d = []                                                                                    #     Create a temporary empty list for list of point_________________________                    \
    temp_tag2d = []                                                                                    #     Create a temporary empty list for list of tag                           \                    \
    for j in range(y_length):                                                                          #     Iterate through y_length; y direction in this case                       \                    \
        temp_arr1d = []                                                                                #         Create a temporary empty list for point                               \                    \
        temp_tag1d = []                                                                                #         Create a temporary empty list for tag                                  \                    \
        for k in range(x_length):                                                                      #         Iterate through x_length; x direction in this case__                    \                    \
            grid_pt = rg.Point3d(k*edge_length, j*edge_length, i*edge_length)                          #             Create a point                                  \                    \                    \
            text = '({},{},{})'.format(k, j, i)                                                        #             Create a string                                  } 1d array; x-dir    } 2d array; y-dir    } 3d array; z-dir
            temp_arr1d.append(grid_pt)                                                                 #             Append the point into the list; temp_arr1d      /                    /                    /
            temp_tag1d.append(text)                                                                    #             Append the string into the list; temp_tag1d    /                    /                    /
            print('\nindex_x: {}, \nindex_y: {}, \nindex_z: {}, \nitem: {}'.format(k, j, i, grid_pt))  #             Print the index and item to check_____________/                    /                    /
        temp_arr2d.append(temp_arr1d)                                                                  #         Append the temp_arr1d into the list; temp_arr2d                       /                    /
        temp_tag2d.append(temp_tag1d)                                                                  #         Append the temp_tag1d into the list; temp_tag2d______________________/                    /
    arr3d.append(temp_arr2d)                                                                           #     Append the temp_arr2d into the list; arr3d                                                   /
    tag3d.append(temp_tag2d)                                                                           #     Append the temp_tag2d into the list; tag3d__________________________________________________/



# visualize for grasshopper
arr1d = th.list_to_tree(arr1d)
tag1d = th.list_to_tree(tag1d)
arr2d = th.list_to_tree(arr2d)
tag2d = th.list_to_tree(tag2d)
arr3d = th.list_to_tree(arr3d)
tag3d = th.list_to_tree(tag3d)
# ---------- end _01_array_with_item ----------

# ----
# base grid
_02_array_with_geometry = GhPythonScript(x_length=number_slider, y_length=number_slider_2, z_length=number_slider_3, edge_length=edge_length)  # -> out, arr1d, arr2d, arr3d; inputs x_length: Int32, y_length: Int32, z_length: Int32
# ---------- _02_array_with_geometry: Python ----------
'''
ABOUT:
This is a file explaining about array with geometry.
'''



# import module
import Rhino.Geometry as rg          # for geometrical operation using Rhino.Geometry namaspace
import ghpythonlib.treehelpers as th # for data translation between python-list and gh-tree



# create original box
base_plane = rg.Plane.WorldXY                                          # set a base plane
edge_interval = rg.Interval(-edge_length/2, edge_length/2)             # Create an interval for propotion of the box
box = rg.Box(base_plane, edge_interval, edge_interval, edge_interval)  # Create a box as module
centroid = box.Center                                                  # get the centroid of the box for transformation later



# 1d array with polygons
arr1d = []                               # Create an empty list for boxes_____________________________________
for i in range(x_length):                # Iterate through x_length; x direction                              \
    grid_pt = rg.Point3d(i*edge_length,  # Create a point, using i(x_length) as x coordinate,                  \
                         0,              #                       0 as y coordinate                              \
                         0)              #                       0 as z coordinate                               \
    vec = grid_pt - centroid             #     Calculate a vector from centroid of original box to grid_pt        \
    T = rg.Transform.Translation(vec)    #     Calculate a transformation matrix from the vector above             } 1d array; x-dir
    box_transformed = box.Clone()        #     Make a clone(=deepcopy) of the original box to keep it             /
    box_transformed.Transform(T)         #     Transform(=move) the cloned box from original centroid to grid_pt /
    arr1d.append(box_transformed)        #     Append the transformed box to the list; arr1d____________________/



# # 2d array with polygons
arr2d = []                                   # Create an empty list for lists of box_________________________________________________________
for i in range(y_length):                    # Iterate through y_length; y direction                                                         \
    arr1d_temp = []                          #     Create an empty list for boxes_________________________________________                    \
    for j in range(x_length):                #     Iterate through x_length; x direction                                  \                    \
        grid_pt = rg.Point3d(j*edge_length,  #         Create a point, using j(x_length) as x coordinate,                  \                    \
                             i*edge_length,  #                               i(y_length) as y coordinate,                   \                    \
                             0)              #                               0 for z coordinate                              \                    \
        vec = grid_pt - centroid             #         Calculate a vector from centroid of the original box to grid_pt        \                    \
        T = rg.Transform.Translation(vec)    #         Calculate a transformation matrix from the vector above                 } 1d array; x-dir    } 2d array; y-dir
        box_transformed = box.Clone()        #         Make a clone(=deepcopy) of the original box to keep it                 /                    /
        box_transformed.Transform(T)         #         Transform(=move) the cloned box from original centroid to grid_pt     /                    /
        arr1d_temp.append(box_transformed)   #     Append the transformed box into the list; arr1d_temp_____________________/                    /
    arr2d.append(arr1d_temp)                 # Append the list of boxes into the list; arr2d____________________________________________________/



# 3d array with box
arr3d = []                                       # Create an empty list for list of list of boxes______________________________________________________________________
for i in range(z_length):                        # Iterate through z_length; z-dir                                                                                     \
    arr2d_temp = []                              #     Create an empty list for list of boxes_______________________________________________________                    \
    for j in range(y_length):                    #     Iterate through y_length; y-dir                                                              \                    \
        arr1d_temp = []                          #         Create an empty list for boxes________________________________________                    \                    \
        for k in range(x_length):                #         Iterate through x_length; x-dir                                       \                    \                    \
            grid_pt = rg.Point3d(k*edge_length,  #             Create a point, using k(x_length) as x coordinate                  \                    \                    \
                                 j*edge_length,  #                                   j(y_length) as y coordinate                   \                    \                    \
                                 i*edge_length)  #                                   i(z_length) as z coordinate                    \                    \                    \
            vec = grid_pt - centroid             #             Calculate a vector from centroid of the original box to grid_pt       } 1d array; x-dir    } 2d array; y-dir    } 3d array; z-dir
            T = rg.Transform.Translation(vec)    #             Calculate a transformation matrix from the vector above              /                    /                    /
            box_transformed = box.Clone()        #             Make a clone(=deepcopy) of the original box to keep it              /                    /                    /
            box_transformed.Transform(T)         #             Transform(=move) the cloned box from original centroid to grid_pt  /                    /                    /
            arr1d_temp.append(box_transformed)   #             Append the transformed box into the list; arr1d_temp______________/                    /                    /
        arr2d_temp.append(arr1d_temp)            #         Append the list of boxes into the list; arr2d_temp________________________________________/                    /
    arr3d.append(arr2d_temp)                     #     Append the list of list of boxes into the list; arr3d_____________________________________________________________/



# visualize with grasshopper
arr1d = th.list_to_tree(arr1d)
arr2d = th.list_to_tree(arr2d)
arr3d = th.list_to_tree(arr3d)
# ---------- end _02_array_with_geometry ----------

# ----
# array intro
panel = Panel(_00_array_intro)

# ----
# Answers
# exercise 4: 4-0.
# By customizing 02_array_with_geometry...
# 
# 4-1.
# Make a 3d array with boxes which have different edge_lengths for x, y and z, and change the propotion of the boxes
number_slider_4 = Slider(5, range=1..10)
# exercise 5: 5-0.
# From scratch...
# 
# 5-1.
# Make a 3d array with boxes whose propotion is changed gradationally.
edge_length_2 = Slider(1, range=0.1..10)
answer_4 = GhPythonScript(x_length=number_slider_4, y_length=Slider(4, range=1..10), z_length=Slider(3, range=1..10), edge_length=edge_length_2)  # -> out, arr3d; inputs x_length: Int32, y_length: Int32, z_length: Int32
# ---------- answer_4: Python ----------
'''
ABOUT:
This is a starting point of exercise 4
'''



# import module
import Rhino.Geometry as rg          # for geometrical operation using Rhino.Geometry namaspace
import ghpythonlib.treehelpers as th # for data translation between python-list and gh-tree



# create original box
base_plane = rg.Plane.WorldXY                                          # set a base plane
edge_interval = rg.Interval(-edge_length/2, edge_length/2)             # Create an interval for propotion of the box
box = rg.Box(base_plane, edge_interval, edge_interval, edge_interval)  # Create a box as module
centroid = box.Center                                                  # get the centroid of the box for transformation later



# 3d array with box
arr3d = []                                       # Create an empty list for list of list of boxes______________________________________________________________________
for i in range(z_length):                        # Iterate through z_length; z-dir                                                                                     \
    arr2d_temp = []                              #     Create an empty list for list of boxes_______________________________________________________                    \
    for j in range(y_length):                    #     Iterate through y_length; y-dir                                                              \                    \
        arr1d_temp = []                          #         Create an empty list for boxes________________________________________                    \                    \
        for k in range(x_length):                #         Iterate through x_length; x-dir                                       \                    \                    \
            grid_pt = rg.Point3d(k*edge_length,  #             Create a point, using k(x_length) as x coordinate                  \                    \                    \
                                 j*edge_length,  #                                   j(y_length) as y coordinate                   \                    \                    \
                                 i*edge_length)  #                                   i(z_length) as z coordinate                    \                    \                    \
            vec = grid_pt - centroid             #             Calculate a vector from centroid of the original box to grid_pt       } 1d array; x-dir    } 2d array; y-dir    } 3d array; z-dir
            T = rg.Transform.Translation(vec)    #             Calculate a transformation matrix from the vector above              /                    /                    /
            box_transformed = box.Clone()        #             Make a clone(=deepcopy) of the original box to keep it              /                    /                    /
            box_transformed.Transform(T)         #             Transform(=move) the cloned box from original centroid to grid_pt  /                    /                    /
            arr1d_temp.append(box_transformed)   #             Append the transformed box into the list; arr1d_temp______________/                    /                    /
        arr2d_temp.append(arr1d_temp)            #         Append the list of boxes into the list; arr2d_temp________________________________________/                    /
    arr3d.append(arr2d_temp)                     #     Append the list of list of boxes into the list; arr3d_____________________________________________________________/



# visualize with grasshopper
arr3d = th.list_to_tree([[[k for k in j] for j in i] for i in arr3d])
# ---------- end answer_4 ----------
box = Box(answer_4.arr3d)

pt = Point(_01_array_with_item.arr1d)
txt = Text(_01_array_with_item.tag1d)
pt_2 = Point(_01_array_with_item.arr3d)
txt_2 = Text(_01_array_with_item.tag3d)
pt_3 = Point(_01_array_with_item.arr2d)
txt_3 = Text(_01_array_with_item.tag2d)

# ----
# Exercises
# Questions
# exercise 1: 1-0.
# Using arr3d output from 01_array_with_item component...
# 
# 1-1.
# Pick up one point from the array by specifying x, y and z index.
input = Geometry(pt_2)

# ---- group: Box
box_2 = Box(_02_array_with_geometry.arr1d)
box_3 = Box(_02_array_with_geometry.arr3d)

# ----
# exercise 2: 2-0.
# Using the box_arr3d output from 02_array_with_tessellation
# component...
# 
# 2-1.
# Pick up a group of boxes from the array by specifying x, y and z start index and its length (like slicing)
input_2 = Geometry(box_3)
# exercise 3: 3-0.
# Using the box_arr3d output from 02_array_with_tessellation
# component...
# 
# 3-1.
# Add some lines to the component above to avoid "IndexError": list index out of range.
# 
# 3-2.
# Return None instead, and print some message.
input_3 = Geometry(box_3)

# ---- group: Box
box_4 = Box(_02_array_with_geometry.arr2d)

# ----
# selection
list = ValueList({"arr1d": 0, "arr2d": 1, "arr3d": 2}, selected="arr3d")
filter = StreamFilter(Gate=list, Stream0=pt, Stream1=pt_3, Stream2=pt_2)  # -> flatten(Stream)
filter_2 = StreamFilter(Gate=list, Stream0=txt, Stream1=txt_3, Stream2=txt_2)  # -> flatten(Stream)

# ----
# selection
list_2 = ValueList({"arr1d": 0, "arr2d": 1, "arr3d": 2}, selected="arr3d")
filter_3 = StreamFilter(Gate=list_2, Stream0=box_2, Stream1=box_4, Stream2=box_3)  # -> flatten(Stream)

answer_1 = GhPythonScript()  # -> Out, A
answer_2 = GhPythonScript()  # -> Out, A
answer_3 = GhPythonScript()  # -> Out, A
answer_5 = GhPythonScript()  # -> Out, A

pt_4 = Point(filter)
txt_4 = Text(filter_2)

# ----
# visualization
lng = ListLength(List=txt_4)
series = Series(Start=0, Step=1, Count=lng)
gradient = Gradient(
    LowerLimit=0,
    UpperLimit=lng,
    Parameter=series,
    stops=[0: RGB(243, 57, 0), 0.1: RGB(236, 27, 60), 0.2: RGB(210, 0, 118), 0.3: RGB(103, 0, 120), 0.4: RGB(39, 72, 161), 0.5: RGB(1, 192, 229), 0.6: RGB(18, 178, 90), 0.7: RGB(79, 186, 8), 0.8: RGB(220, 237, 32), 0.9: RGB(247, 159, 20), 1: RGB(243, 57, 0)])
symsim = SymbolSimple(Style=3, Size=5, Rotation=0, Colour=gradient)

# ----
# Examples
geo = Geometry(pt_2)  # disabled
x = Slider(0, range=0..10)  # disabled
y = Slider(0, range=0..10)  # disabled
number_slider_5 = Slider(0, range=0..10)  # disabled
geo_2 = Geometry(box_3)  # disabled
x_start = Slider(1, range=0..10)  # disabled
x_len = Slider(4, range=0..10)  # disabled
y_start = Slider(1, range=0..10)  # disabled
y_len = Slider(2, range=0..10)  # disabled
z_start = Slider(1, range=0..10)  # disabled
z_len = Slider(2, range=0..10)  # disabled
geo_3 = Geometry(box_3)  # disabled
x_start_2 = Slider(1, range=0..10)  # disabled
x_len_2 = Slider(3, range=0..10)  # disabled
y_start_2 = Slider(1, range=0..10)  # disabled
y_len_2 = Slider(2, range=0..10)  # disabled
z_start_2 = Slider(1, range=0..10)  # disabled
z_len_2 = Slider(2, range=0..10)  # disabled
exmaple_1 = GhPythonScript(arr3d=geo, x=x, y=y, z=number_slider_5)  # -> out, selected; inputs arr3d: tree of GeometryBase, x: Int32, y: Int32, z: Int32; disabled
# ---------- exmaple_1: Python ----------
import ghpythonlib.treehelpers as th

arr3d = th.tree_to_list(arr3d)

selected = arr3d[z][y][x]
# ---------- end exmaple_1 ----------
example_2 = GhPythonScript(arr3d=geo_2, x_start=x_start, x_len=x_len, y_start=y_start, y_len=y_len, z_start=z_start, z_len=z_len)  # -> out, selected; inputs arr3d: tree of GeometryBase, x_start: Int32, x_len: Int32, y_start: Int32, y_len: Int32, z_start: Int32, z_len: Int32; disabled
# ---------- example_2: Python ----------
import ghpythonlib.treehelpers as th

arr3d = th.tree_to_list(arr3d)

selected = []
for i in range(z_start, (z_start + z_len)):
    arr2d = arr3d[i]
    for j in range(y_start, (y_start + y_len)):
        arr1d = arr2d[j]
        for k in range(x_start, (x_start + x_len)):
            item = arr1d[k]
            selected.append(item)
selected = th.list_to_tree(selected)
# ---------- end example_2 ----------

# ---- group: GhPython Script
number_slider_6 = Slider(5, range=1..10)  # disabled
number_slider_7 = Slider(4, range=1..10)  # disabled
number_slider_8 = Slider(3, range=1..10)  # disabled
x_edge_length = Slider(3.4, range=0.1..10)  # disabled
y_edge_length = Slider(7.7, range=0.1..10)  # disabled
z_edge_length = Slider(1.3, range=0.1..10)  # disabled
number_slider_9 = Slider(10, range=1..10)  # disabled
number_slider_10 = Slider(9, range=1..10)  # disabled
number_slider_11 = Slider(8, range=1..10)  # disabled
edge_length_min = Slider(1, range=0.1..10)  # disabled
edge_length_max = Slider(10, range=0.1..10)  # disabled
example_4 = GhPythonScript(
    x_length=number_slider_6,
    y_length=number_slider_7,
    z_length=number_slider_8,
    x_edge_length=x_edge_length,
    y_edge_length=y_edge_length,
    z_edge_length=z_edge_length)  # -> out, arr3d; inputs x_length: Int32, y_length: Int32, z_length: Int32, y_edge_length: Int32, z_edge_length: Int32; disabled
# ---------- example_4: Python ----------
'''
ABOUT:
This is a file to show the example of answer of exercise.
'''



# import module
import Rhino.Geometry as rg          # for geometrical operation using Rhino.Geometry namaspace
import ghpythonlib.treehelpers as th # for data translation between python-list and gh-tree



# create original box
base_plane = rg.Plane.WorldXY                                                # set a base plane
x_edge_interval = rg.Interval(-x_edge_length/2, x_edge_length/2)             # Create an interval for x propotion of the box
y_edge_interval = rg.Interval(-y_edge_length/2, y_edge_length/2)             # Create an interval for y propotion of the box
z_edge_interval = rg.Interval(-z_edge_length/2, z_edge_length/2)             # Create an interval for z propotion of the box
box = rg.Box(base_plane, x_edge_interval, y_edge_interval, z_edge_interval)  # Create a box as module
centroid = box.Center                                                        # get the centroid of the box for transformation later



# 3d array with box
arr3d = []                                         # Create an empty list for list of list of boxes______________________________________________________________________
for i in range(z_length):                          # Iterate through z_length; z-dir                                                                                     \
    arr2d_temp = []                                #     Create an empty list for list of boxes_______________________________________________________                    \
    for j in range(y_length):                      #     Iterate through y_length; y-dir                                                              \                    \
        arr1d_temp = []                            #         Create an empty list for boxes________________________________________                    \                    \
        for k in range(x_length):                  #         Iterate through x_length; x-dir                                       \                    \                    \
            grid_pt = rg.Point3d(k*x_edge_length,  #             Create a point, using k(x_length) as x coordinate                  \                    \                    \
                                 j*y_edge_length,  #                                   j(y_length) as y coordinate                   \                    \                    \
                                 i*z_edge_length)  #                                   i(z_length) as z coordinate                    \                    \                    \
            vec = grid_pt - centroid               #             Calculate a vector from centroid of the original box to grid_pt       } 1d array; x-dir    } 2d array; y-dir    } 3d array; z-dir
            T = rg.Transform.Translation(vec)      #             Calculate a transformation matrix from the vector above              /                    /                    /
            box_transformed = box.Clone()          #             Make a clone(=deepcopy) of the original box to keep it              /                    /                    /
            box_transformed.Transform(T)           #             Transform(=move) the cloned box from original centroid to grid_pt  /                    /                    /
            arr1d_temp.append(box_transformed)     #             Append the transformed box into the list; arr1d_temp______________/                    /                    /
        arr2d_temp.append(arr1d_temp)              #         Append the list of boxes into the list; arr2d_temp________________________________________/                    /
    arr3d.append(arr2d_temp)                       #     Append the list of list of boxes into the list; arr3d_____________________________________________________________/



# visualize with grasshopper
arr3d = th.list_to_tree([[[k for k in j] for j in i] for i in arr3d])
# ---------- end example_4 ----------
example_3 = GhPythonScript(arr3d=geo_3, x_start=x_start_2, x_len=x_len_2, y_start=y_start_2, y_len=y_len_2, z_start=z_start_2, z_len=z_len_2)  # -> out, selected; inputs arr3d: tree of GeometryBase, x_start: Int32, x_len: Int32, y_start: Int32, y_len: Int32, z_start: Int32, z_len: Int32; disabled
# ---------- example_3: Python ----------
import ghpythonlib.treehelpers as th

arr3d = th.tree_to_list(arr3d)

try:
    selected = []
    for i in range(z_start, (z_start + z_len)):
        arr2d = arr3d[i]
        for j in range(y_start, (y_start + y_len)):
            arr1d = arr2d[j]
            for k in range(x_start, (x_start + x_len)):
                item = arr1d[k]
                selected.append(item)
    selected = th.list_to_tree(selected)
except IndexError:
    selected = None
    print('index out of range')
# ---------- end example_3 ----------
_02_array_with_geometry_2 = GhPythonScript(
    x_length=number_slider_9,
    y_length=number_slider_10,
    z_length=number_slider_11,
    edge_length_min=edge_length_min,
    edge_length_max=edge_length_max)  # -> out, arr3d; inputs x_length: Int32, y_length: Int32, z_length: Int32; disabled
# ---------- _02_array_with_geometry_2: Python ----------
'''
ABOUT:
This is a file explaining about array with geometry.
'''



# import module
import Rhino.Geometry as rg
import ghpythonlib.treehelpers as th



# create function
def remap_value(value, ori_min, ori_max, to_min=0, to_max=1):
    delta = ori_max - ori_min
    delta_target = to_max - to_min
    step = delta_target / delta
    new_value = to_min + (value-ori_min) * step
    return new_value, step



# 3d array with box
z_coord = 0
arr3d = []
for i in range(z_length):
    arr2d_temp = []
    y_coord = 0
    for j in range(y_length):
        arr1d_temp = []
        x_coord = 0
        for k in range(x_length):
            # x,y,z range and step
            remapped_x, step_x = remap_value(k, 0, x_length-1, edge_length_min, edge_length_max)
            remapped_y, step_y = remap_value(j, 0, y_length-1, edge_length_min, edge_length_max)
            remapped_z, step_z = remap_value(i, 0, z_length-1, edge_length_min, edge_length_max)
            # x,y,z edge_interval
            edge_interval_x = rg.Interval(-remapped_x/2, remapped_x/2)
            edge_interval_y = rg.Interval(-remapped_y/2, remapped_y/2)
            edge_interval_z = rg.Interval(-remapped_z/2, remapped_z/2)
            # create box
            center = rg.Point3d(x_coord, y_coord, z_coord)
            base_plane = rg.Plane(center, rg.Vector3d.XAxis, rg.Vector3d.YAxis)
            box = rg.Box(base_plane, edge_interval_x, edge_interval_y, edge_interval_z)
            # append box into arr1d
            arr1d_temp.append(box)
            # update x coordinate
            x_coord = center.X + remapped_x + step_x/2
        # append box into arr1d
        arr2d_temp.append(arr1d_temp)
        # update y coordinate
        y_coord = center.Y + remapped_y + step_y/2
    # append box into arr1d
    arr3d.append(arr2d_temp)
    # update z coordinate
    z_coord = center.Z + remapped_z + step_z/2



# visualize with grasshopper
arr3d = th.list_to_tree([[[k for k in j] for j in i] for i in arr3d])
# ---------- end _02_array_with_geometry_2 ----------
geo_4 = Geometry(exmaple_1.selected)  # disabled
geo_5 = Geometry(example_2.selected)  # disabled
geo_6 = Geometry(example_3.selected)  # disabled
box_5 = Box(example_4.arr3d)  # disabled
box_6 = Box(_02_array_with_geometry_2.arr3d)  # disabled

# ----
symbol = SymbolDisplay(Location=pt_4, Display=symsim)
tag = TextTag3D(Location=pt_4, Text=txt_4, Size=0.175, Colour=gradient, Justification=2)

# ----
# array with box
geo_7 = Geometry(filter_3)

# ----
# visualization
lng_2 = ListLength(List=geo_7)
series_2 = Series(Start=0, Step=1, Count=lng_2)
gradient_2 = Gradient(
    LowerLimit=0,
    UpperLimit=lng_2,
    Parameter=series_2,
    stops=[0: RGB(243, 57, 0), 0.1: RGB(236, 27, 60), 0.2: RGB(210, 0, 118), 0.3: RGB(103, 0, 120), 0.4: RGB(39, 72, 161), 0.5: RGB(1, 192, 229), 0.6: RGB(18, 178, 90), 0.7: RGB(79, 186, 8), 0.8: RGB(220, 237, 32), 0.9: RGB(247, 159, 20), 1: RGB(243, 57, 0)])
dup = DuplicateData(Data=0.7, Number=lng_2, Order=True)
material = CreateMaterial(Diffuse=gradient_2, Specular=RGB(255, 255, 255), Emission=RGBA(0, 0, 0, 0), Transparency=dup, Shine=0)

preview = CustomPreview(Geometry=geo_7, Material=material)
