# Grasshopper definition 01_module_design_basic.ghx (Grasshopper 1.0.7)

# ----
# legend
# group of component
# input to change
# output to visuzlize
# data to pass
# copied from other file
# author: name: Ko Tsuruta
# copyright: © 2021 Ko Tsuruta
# email: trtku0809@gmail.com
# exercise
image_gallery = ImageGallery(
    CycleDelay=30,
    Randomize=False,
    UseLocalImages=True,
    UseRemoteImages=True,
    RemoteUrl="https://live.staticflickr.com/65535/51729808202_8bc46e4245_m.jpg")

# ----
# parameters
number_slider = Slider(3, range=1..10)
number_slider_2 = Slider(3, range=1..10)
number_slider_3 = Slider(2, range=1..10)
edge_length = Slider(1, range=0.1..10)

value_list = ValueList({"Cube": 0, "Sphere": 1}, selected="Cube")
run = BooleanToggle(True)
truncation = BooleanToggle(True)
t_factor = Slider(0.6, range=0..2)

# ----
# 00_array_basics.ghx
# base grid
_02_array_with_geometry = GhPythonScript(x_length=number_slider, y_length=number_slider_2, z_length=number_slider_3, edge_length=edge_length)  # -> out, arr3d; inputs x_length: Int32, y_length: Int32, z_length: Int32
# ---------- _02_array_with_geometry: Python ----------
'''
ABOUT:
This is a file explaining about array with geometry using class

'''



# import module
import Rhino.Geometry as rg          # for geometrical operation using Rhino.Geometry namaspace
import ghpythonlib.treehelpers as th # for data translation between python-list and gh-tree



# create original box
base_plane = rg.Plane.WorldXY                                          # set a base plane_______________________________________
edge_interval = rg.Interval(-edge_length/2, edge_length/2)             # Create an interval for propotion of the box            \
box = rg.Box(base_plane, edge_interval, edge_interval, edge_interval)  # Create a box as module                                  } class
centroid = box.Center                                                  # get the centroid of the box for transformation later___/



# 3d array with box
arr3d = []                                       # Create an empty list for list of list of boxes______________________________________________________________________
for i in range(z_length):                        # Iterate through z_length; z-dir                                                                                     \
    arr2d_temp = []                              #     Create an empty list for list of boxes_______________________________________________________                    \
    for j in range(y_length):                    #     Iterate through y_length; y-dir                                                              \                    \
        arr1d_temp = []                          #         Create an empty list for boxes________________________________________                    \                    \
        for k in range(x_length):                #         Iterate through x_length; x-dir                                       \                    \                    \
            grid_pt = rg.Point3d(k*edge_length,  #             Create a point, using k(x_length) as x coordinate                  \                    \                    \
                                 j*edge_length,  #                                   j(y_length) as y coordinate                   \                    \                    \
                                 i*edge_length)  #                                   i(z_length) as z coordinate                    \                    \                    \
            vec = grid_pt - centroid             #             Calculate a vector from centroid of the original box to grid_pt       } 1d array; x-dir    } 2d array; y-dir    } 3d array; z-dir
            T = rg.Transform.Translation(vec)    #             Calculate a transformation matrix from the vector above              /                    /                    /
            box_transformed = box.Clone()        #             Make a clone(=deepcopy) of the original box to keep it              /                    /                    /
            box_transformed.Transform(T)         #             Transform(=move) the cloned box from original centroid to grid_pt  /                    /                    /
            arr1d_temp.append(box_transformed)   #             Append the transformed box into the list; arr1d_temp______________/                    /                    /
        arr2d_temp.append(arr1d_temp)            #         Append the list of boxes into the list; arr2d_temp________________________________________/                    /
    arr3d.append(arr2d_temp)                     #     Append the list of list of boxes into the list; arr3d_____________________________________________________________/



# visualize with grasshopper
arr3d = th.list_to_tree(arr3d)
# ---------- end _02_array_with_geometry ----------

# ----
# array with a class
# base grid
array_with_class = GhPythonScript(x_length=number_slider, y_length=number_slider_2, z_length=number_slider_3, edge_length=edge_length)  # -> out, arr3d; inputs x_length: Int32, y_length: Int32, z_length: Int32
# ---------- array_with_class: Python ----------
'''
ABOUT:
This is a file explaining about array with geometry using class

'''



# import module
import Rhino.Geometry as rg          # for geometrical operation using Rhino.Geometry namaspace
import ghpythonlib.treehelpers as th # for data translation between python-list and gh-tree



# create a class for module
class Cube(object):       # name the class without inheritence
    
    # set class variables (=class attribute) which are shared by all the instances
    module_type = 'cube'  # an attribute to check the module type
    
    # initialize method with arguments
    def __init__(self,                      # init method with first arguments, self, which binds attributes
                                            # SOURCE:
                                            # https://www.geeksforgeeks.org/self-in-python-class/
                 x=0,                       # x coordinate of the centroid of the module, default:0
                 y=0,                       # y coordinate of the centroid of the module, default:0
                 z=0,                       # z coordinate of the centroid of the module, default:0
                 edge_length_x=1,           # edge length in x direction, default:1
                 edge_length_y=1,           # edge length in y direction, default:1
                 edge_length_z=1):          # edge length in z direction, default:1
                                            #     set instance variables (=instance attribute) which are unique to each instance
        self.X = x                          #     set input:x as attribute:X
        self.Y = y                          #     set input:y as attribute:Y
        self.Z = z                          #     set input:z as attribute:Z
        self.edge_length_x = edge_length_x  #     set input:edge_length_x as attribute
        self.edge_length_y = edge_length_y  #     set input:edge_length_y as attribute
        self.edge_length_z = edge_length_z  #     set input:edge_length_z as attribute
        self.draw()                         #     call a function to create a module with actual geometry
    
    # a method to get interval in x, y and z direction
    def get_xyz_interval(self):                                                     # name the method with no argument except for self
        self.interval_x = rg.Interval(-self.edge_length_x/2, self.edge_length_x/2)  #     interval in x direction from negative half to positive half
        self.interval_y = rg.Interval(-self.edge_length_y/2, self.edge_length_y/2)  #     interval in y direction from negative half to positive half
        self.interval_z = rg.Interval(-self.edge_length_z/2, self.edge_length_z/2)  #     interval in z direction from negative half to positive half
    
    # a method to get centroid with instance variables
    def get_centroid(self):                                 # name the method with no argument except for self
        self.centroid = rg.Point3d(self.X, self.Y, self.Z)  #     set centroid with actual geometry; rg.Point3d
    
    # a method to get base plane around the centroid
    def get_base_plane(self):                                                       # name the method with no argument except for self
        self.get_centroid()                                                         #     call the get_centroid method
        base_plane = rg.Plane(self.centroid, rg.Vector3d.XAxis, rg.Vector3d.YAxis)  #     set base plane with actual geometry; rg.Plane
        return base_plane                                                           #     return the plane
    
    # a method to get an actual geometry of the module
    def draw(self):                                                                  # name the method with no argument except for self
        base_plane = self.get_base_plane()                                           #     call the get_base_plane method to get the plane
        self.get_xyz_interval()                                                      #     call the get_xyz_interval method to get intervals
        box = rg.Box(base_plane, self.interval_x, self.interval_y, self.interval_z)  #     create a box
        self.module = box                                                            #     set the box as attribute; module



# 3d array with box
arr3d = []                               # create an empty list, arr3d_______________________________________________________
for i in range(z_length):                # iterate through z_length                                                          \
    arr2d_temp = []                      #     create an empty list, arr2d_temp____________________________________           \
    for j in range(y_length):            #     iterate through y_length                                            \           \
        arr1d_temp = []                  #         create an empty list, arr1d_temp______________________           \           \
        for k in range(x_length):        #         iterate through x_length                              \           \           \
            c = Cube(k*edge_length,      #             create an instance of Cube class with arguments    } 1d array  } 2d array  } 3d array
                     j*edge_length,      #                                                               /           /           /
                     i*edge_length,      #                                                              /           /           /
                     edge_length,        #                                                             /           /           /
                     edge_length,        #                                                            /           /           /
                     edge_length)        #                                                           /           /           /
            arr1d_temp.append(c.module)  #             append the module into the list, arr1d_temp__/           /           /
        arr2d_temp.append(arr1d_temp)    #         append the arr1d_temp into the list, arr2d_temp_____________/           /
    arr3d.append(arr2d_temp)             #     append the arr2d_temp into the list, arr3d_________________________________/



# visualize with grasshopper
arr3d = th.list_to_tree(arr3d)
# ---------- end array_with_class ----------
data = Data(array_with_class.arr3d)

# ----
# base class
cube = GhPythonScript()  # -> Cube, module
# ---------- cube: Python ----------
'''
ABOUT:
This is a file to create a Cube class
'''



# import module
import Rhino.Geometry as rg



# create a class for module
class Cube(object):
    
    # set class variables (=class attribute) which are shared by all the instances
    module_type = 'cube'
    
    # initialize method with arguments
    def __init__(self, x=0, y=0, z=0, edge_length_x=1, edge_length_y=1, edge_length_z=1):
        self.X = x
        self.Y = y
        self.Z = z
        self.edge_length_x = edge_length_x
        self.edge_length_y = edge_length_y
        self.edge_length_z = edge_length_z
        self.draw()
    
    # a method to get interval in x, y and z direction
    def get_xyz_interval(self):
        self.interval_x = rg.Interval(-self.edge_length_x/2, self.edge_length_x/2)
        self.interval_y = rg.Interval(-self.edge_length_y/2, self.edge_length_y/2)
        self.interval_z = rg.Interval(-self.edge_length_z/2, self.edge_length_z/2)
    
    # a method to get centroid with instance variables
    def get_centroid(self):
        self.centroid = rg.Point3d(self.X, self.Y, self.Z)
    
    # a method to get base plane around the centroid
    def get_base_plane(self):
        self.get_centroid()
        self.base_plane = rg.Plane(self.centroid, rg.Vector3d.XAxis, rg.Vector3d.YAxis)
    
    # a method to get an actual geometry of the module
    def draw(self):
        self.get_base_plane()
        self.get_xyz_interval()
        box = rg.Box(self.base_plane, self.interval_x, self.interval_y, self.interval_z)
        self.module = box



# create an instance for test
c = Cube()
module = c.module
# ---------- end cube ----------
# array with class + truncation
sphere = GhPythonScript()  # -> Sphere, module
# ---------- sphere: Python ----------
'''
ABOUT:
This is a file to create a Sphere class
'''



# import module
import Rhino.Geometry as rg



# create a class for module
class Sphere(object):
    
    # set class variables (=class attribute) which are shared by all the instances
    module_type = 'sphere'
    
    # initialize method with arguments
    def __init__(self, x=0, y=0, z=0, edge_length_x=1, edge_length_y=1, edge_length_z=1, radius=.5):
        self.X = x
        self.Y = y
        self.Z = z
        self.R = radius
        self.edge_length_x = edge_length_x
        self.edge_length_y = edge_length_y
        self.edge_length_z = edge_length_z
        self.draw()
    
    # a method to get centroid with instance variables
    def get_centroid(self):
        self.centroid = rg.Point3d(self.X, self.Y, self.Z)
    
    # a method to get base plane around the centroid
    def get_base_plane(self):
        self.get_centroid()
        self.base_plane = rg.Plane(self.centroid, rg.Vector3d.XAxis, rg.Vector3d.YAxis)
    
    # a method to get an actual geometry of the module
    def draw(self):
        self.get_base_plane()
        self.module = rg.Sphere(self.base_plane.Origin, self.R)



# create an instance for test
s = Sphere()
module = s.module
# ---------- end sphere ----------

# ---- group: Geometry
geometry = Geometry(cube.module)
geometry_2 = Geometry(sphere.module)

# ----
box = Box(_02_array_with_geometry.arr3d)

# ----
# selection
value_list_2 = ValueList({"arr1d": 0, "arr2d": 1, "arr3d": 2}, selected="arr3d")
stream_filter = StreamFilter(Gate=value_list_2, Stream2=box)  # -> flatten(Stream)

# ----
# base class
cube_2 = GhPythonScript(t_factor=t_factor)  # -> Cube, module, t_module
# ---------- cube_2: Python ----------
# import module
import Rhino.Geometry as rg
import Rhino.RhinoMath as rm  # module to get minimum tolerance in rhino



# create a class for module
class Cube(object):
    
    # set class variables (=class attribute) which are shared by all the instances
    module_type = 'cube'
    distol = rm.ZeroTolerance
    
    # initialize method with arguments
    def __init__(self, x=0, y=0, z=0, edge_length_x=1, edge_length_y=1, edge_length_z=1):
        self.X = x
        self.Y = y
        self.Z = z
        self.edge_length_x = edge_length_x
        self.edge_length_y = edge_length_y
        self.edge_length_z = edge_length_z
        self.draw()
        self.to_brep()
    
    # a method to get interval in x, y and z direction
    def get_xyz_interval(self):
        self.interval_x = rg.Interval(-self.edge_length_x/2, self.edge_length_x/2)
        self.interval_y = rg.Interval(-self.edge_length_y/2, self.edge_length_y/2)
        self.interval_z = rg.Interval(-self.edge_length_z/2, self.edge_length_z/2)
    
    # a method to get centroid with instance variables
    def get_centroid(self):
        self.centroid = rg.Point3d(self.X, self.Y, self.Z)
    
    # a method to get base plane around the centroid
    def get_base_plane(self):
        self.get_centroid()
        self.base_plane = rg.Plane(self.centroid, rg.Vector3d.XAxis, rg.Vector3d.YAxis)
    
    # a method to get an actual geometry of the module
    def draw(self):
        self.get_base_plane()
        self.get_xyz_interval()
        box = rg.Box(self.base_plane, self.interval_x, self.interval_y, self.interval_z)
        self.module = box
    
    ##############################
    ### methods for truncation ###
    ##############################
    
    # a method to translate a structure to brep
    def to_brep(self):                           # name method with an argument
        self.module_brep = self.module.ToBrep()  # set the brep as an attributes
    
    # a method to get vertices of the box
    def get_vertices(self):                       # name method with an argument
        verts = self.module_brep.Vertices         # get vertices from box structure
        self.verts = [v.Location for v in verts]  # get actual point geometry from rg.BrepVertex to rg.Point3d
    
    # a method to calculate vectors from centroid to vertices
    def calc_vecs_center2verts(self):                                              # name method with an argument, verts
        self.get_vertices()                                                        # get vertices
        self.center2verts =  [rg.Vector3d(p - self.centroid) for p in self.verts]  # set a list of rg.Vector3d as an attribute
    
    # a method to create planes around vetices
    def create_corner_planes(self):                                             # name method with arguments, verts, vecs
        self.calc_vecs_center2verts()                                           # calculate vectors from centroid to corners
        return [rg.Plane(p, v) for p, v in zip(self.verts, self.center2verts)]  # return a list of rg.Plane
    
    # a method to move planes towards centroid
    def pull_corner_planes(self, pull_factor):              # name method with an arguments, pull_factor
        corner_planes = self.create_corner_planes()         # get planes around corners
        cutter_planes = []                                  # create an empty list
        for p, v in zip(corner_planes, self.center2verts):  # iterate through planes and vectors, from calc_vecs_center2verts and create_corner_planes
            pull_vec = v * pull_factor * (-1)               #     scale the vector according to pull_factor
            T = rg.Transform.Translation(pull_vec)          #     calculate transformation matrix
            p_transformed = p.Clone()                       #     create a deep copy of the plane
            p_transformed.Transform(T)                      #     transform the copied plane
            cutter_planes.append(p_transformed)             #     append the plane into the list, cutter_planes
        return cutter_planes                                # return the list of rg.Planes
    
    # a method to get doubled interval
    def get_double_interval(self, interval):      # name the method with an argument, interval
        new_max = interval.Mid + interval.Length  # calculate new max
        new_min = interval.Mid - interval.Length  # calculate new min
        new_itv = rg.Interval(new_min, new_max)   # create an interval
        return new_itv                            # return the interval
    
    # a method to create a list of surfaces with planes
    def create_cutter(self, pull_factor):                                       # name the method with an argument, pull_factor
        cutter_planes = self.pull_corner_planes(pull_factor)                    # create cutter planes
        itv_x = self.get_double_interval(self.interval_x)                       # get doubled x_interval
        itv_y = self.get_double_interval(self.interval_y)                       # get doubled y_interval
        cutters = []                                                            # create an empty list
        for p in cutter_planes:                                                 # iterate through cutter_planes
            cutter_outline = rg.Rectangle3d(p, itv_x, itv_y)                    #     create a rectangle around the corner plane
            cutter_outline = cutter_outline.ToNurbsCurve()                      #     translate rg.Rectangle3d into rg.NurbsCurve
            cutter = rg.Brep.CreatePlanarBreps(cutter_outline, self.distol)[0]  #     create a brep based on the rectangle
            cutters.append(cutter)                                              #     append the brep into the list, cutters
        return cutters                                                          # return the list
    
    # a method to truncate(cut) the module
    def truncation(self, pull_factor):                                                                  # name method with argument, pull_factor
        if pull_factor == 0:                                                                            # no truncation if the pull_factor is zero
            print('There is no truncation (factor=0)')                                                  #     print a message
        else:                                                                                           # truncation if the pull_factor is NOT zero
            cutters = self.create_cutter(pull_factor)                                                   #     create cutters for truncation
            for i, c in enumerate(cutters):                                                                           #     iterate through the cutters
                try:                                                                                    #         try...
                    self.module_brep = rg.Brep.CreateBooleanSplit(self.module_brep, c, self.distol)[0]  #             try boolean split(success if there's proper intersection)
                except:                                                                                 #         except...
                    print('There is no intersection at {}th cutter'.format(i))                          #             print a message



# create an instance of Cube for test
c = Cube()
c.truncation(t_factor)
module = c.module
t_module = c.module_brep
# ---------- end cube_2 ----------
sphere_2 = GhPythonScript(t_factor=t_factor)  # -> Sphere, module, t_module
# ---------- sphere_2: Python ----------
import Rhino.Geometry as rg
import Rhino.RhinoMath as rm
import copy as c



# create a class for module
class Sphere(object):
    
    # set class variables (=class attribute) which are shared by all the instances
    module_type = 'sphere'
    distol = rm.ZeroTolerance
    
    # initialize method with arguments
    def __init__(self, x=0, y=0, z=0, edge_length_x=1, edge_length_y=1, edge_length_z=1, radius=.5):
        self.X = x
        self.Y = y
        self.Z = z
        self.R = radius
        self.edge_length_x = edge_length_x
        self.edge_length_y = edge_length_y
        self.edge_length_z = edge_length_z
        self.draw()
        self.module_brep = self.to_brep(self.module)
    
    # a method to get interval in x, y and z direction
    def get_xyz_interval(self):
        self.interval_x = rg.Interval(-self.edge_length_x/2, self.edge_length_x/2)
        self.interval_y = rg.Interval(-self.edge_length_y/2, self.edge_length_y/2)
        self.interval_z = rg.Interval(-self.edge_length_z/2, self.edge_length_z/2)
    
    # a method to get centroid with instance variables
    def get_centroid(self):
        self.centroid = rg.Point3d(self.X, self.Y, self.Z)
    
    # a method to get base plane around the centroid
    def get_base_plane(self):
        self.get_centroid()
        self.base_plane = rg.Plane(self.centroid, rg.Vector3d.XAxis, rg.Vector3d.YAxis)
    
    # a method to get an actual geometry of the module
    def draw(self):
        self.get_base_plane()
        self.module = rg.Sphere(self.base_plane.Origin, self.R)
    
    ##############################
    ### methods for truncation ###
    ##############################
    
    # a method to translate a structure to brep
    def to_brep(self, geo):  # name method with an argument, geo
        return geo.ToBrep()  # return the brep
    
    # a method to create scaled module
    def scale_truncation(self, pull_factor):                                            # name method with an argument, pull_factor
        S = rg.Transform.Scale(self.base_plane, pull_factor, pull_factor, pull_factor)  # calculate a transformation matrix
        m_copy = c.deepcopy(self.module)                                                # create a deep copy of the module
        m_copy.Transform(S)                                                             # transform the copied module
        return m_copy                                                                   # return the transformed module
    
    # a method to get bounding box of the sphere
    def get_bbox(self):                                                                    # nema method with no argument
        self.get_xyz_interval()                                                            # get xyz intervals
        bbox = rg.Box(self.base_plane, self.interval_x, self.interval_y, self.interval_z)  # create a box which inscribe the module
        return bbox                                                                        # return the box
    
    # a method to truncate(cut) the module
    def truncation(self, pull_factor):
        scaled_m = self.scale_truncation(pull_factor)                                                              # scale the module
        self.module_brep = self.to_brep(scaled_m)                                                                  # translate the module into brep
        if pull_factor <= 1:                                                                                       # no truncation if the pull_factor is zero
            print('There is no truncation (factor<=1)')                                                            #     print a message
        else:                                                                                                      # truncation if the pull_factor is NOT zero
            bbox = self.get_bbox()                                                                                 #     get the bounding box
            bbox_brep = self.to_brep(bbox)                                                                         #     translate the bbox into brep
            try:                                                                                                   #     try...
                self.module_brep = rg.Brep.CreateBooleanIntersection(self.module_brep, bbox_brep, self.distol)[0]  #         try boolean intersection
            except:                                                                                                #     except...
                self.module_brep = bbox_brep                                                                       #         use bbox as module_brep
                print('There is no intersection')                                                                  #         print a message



# create an instance of Sphere for test
s = Sphere()
s.truncation(t_factor)
module = s.module
t_module = s.module_brep
# ---------- end sphere_2 ----------
geometry_3 = Geometry(cube_2.module)
geometry_4 = Geometry(cube_2.t_module)
geometry_5 = Geometry(sphere_2.module)
geometry_6 = Geometry(sphere_2.t_module)

# ----
# base grid
array_with_class_2 = GhPythonScript(
    x_length=number_slider,
    y_length=number_slider_2,
    z_length=number_slider_3,
    edge_length=edge_length,
    type=value_list,
    run=run,
    truncation=truncation,
    t_factor=t_factor,
    Cube=cube_2.Cube,
    Sphere=sphere_2.Sphere)  # -> out, arr3d; inputs x_length: Int32, y_length: Int32, z_length: Int32, run: Boolean, truncation: Boolean
# ---------- array_with_class_2: Python ----------
'''
ABOUT:
This is a file explaining about array with geometry using class

'''



# import module
import Rhino.Geometry as rg          # for geometrical operation using Rhino.Geometry namaspace
import ghpythonlib.treehelpers as th # for data translation between python-list and gh-tree



# 3d array with geometry
if run:
    arr3d = []                                        # create an empty list, arr3d_________________________________________________
    for i in range(z_length):                         # iterate through z_length                                                    \
        arr2d_temp = []                               #     create an empty list, arr2d_temp______________________________           \
        for j in range(y_length):                     #     iterate through y_length                                      \           \
            arr1d_temp = []                           #         create an empty list, arr2d_temp________________           \           \
            for k in range(x_length):                 #         iterate through x_length                        \           \           \
                print('\nshowing module at index(x:{}, y:{}, z:{})'.format(k, j, i))
                if type==0:                           #             if type is cube                              \           \           \
                    m = Cube(k*edge_length,           #                 create an instance of Cube                \           \           \
                             j*edge_length,           #                                                            \           \           \
                             i*edge_length,           #                                                             \           \           \
                             edge_length,             #                                                              \           \           \
                             edge_length,             #                                                               \           \           \
                             edge_length)             #                                                                \           \           \
                elif type==1:                         #             if type is sphere                                   \           \           \
                    m = Sphere(k*edge_length,         #                 create an instance of Sphere                     } 1d array  } 2d array  } 3d array
                               j*edge_length,         #                                                                 /           /           /
                               i*edge_length,         #                                                                /           /           /
                               edge_length,           #                                                               /           /           /
                               edge_length,           #                                                              /           /           /
                               edge_length,           #                                                             /           /           /
                               radius=edge_length/2)  #                                                            /           /           /
                if truncation:                        #             if truncation...                              /           /           /
                    m.truncation(t_factor)            #                 do truncation                            /           /           /
                arr1d_temp.append(m.module_brep)      #             append the module into the list, arr1d_temp_/           /           /
            arr2d_temp.append(arr1d_temp)             #         append the arr1d_temp into the list, arr2d_temp____________/           /
        arr3d.append(arr2d_temp)                      #     append the arr2d_temp into the list, arr3d________________________________/
    
    
    
    # visualize with grasshopper
    arr3d = th.list_to_tree(arr3d)
# ---------- end array_with_class_2 ----------

modules = Geometry(flatten(array_with_class_2.arr3d))
y_length = Number(number_slider_2)
x_length = Number(number_slider)
z_length = Number(number_slider_3)
edge_length_2 = Number(edge_length)

# ----
# array with classes
value_list_3 = ValueList({"Cube": 0, "Sphere": 1}, selected="Cube")

# ----
# base grid
array_with_class_3 = GhPythonScript(
    x_length=number_slider,
    y_length=number_slider_2,
    z_length=number_slider_3,
    edge_length=edge_length,
    type=value_list_3,
    Cube=cube.Cube,
    Sphere=sphere.Sphere)  # -> out, arr3d; inputs x_length: Int32, y_length: Int32, z_length: Int32
# ---------- array_with_class_3: Python ----------
'''
ABOUT:
This is a file explaining about array with geometry using multiple classes
'''



# import module
import Rhino.Geometry as rg          # for geometrical operation using Rhino.Geometry namaspace
import ghpythonlib.treehelpers as th # for data translation between python-list and gh-tree



# 3d array with geometry
arr3d = []                                        # create an empty list, arr3d_______________________________________________
for i in range(z_length):                         # iterate through z_length                                                  \
    arr2d_temp = []                               #     create an empty list, arr2d_temp____________________________           \
    for j in range(y_length):                     #     iterate through y_length                                    \           \
        arr1d_temp = []                           #         create an empty list, arr2d_temp______________           \           \
        for k in range(x_length):                 #         iterate through x_length                      \           \           \
            if type==0:                           #             if type is cube                            \           \           \
                m = Cube(k*edge_length,           #                 create an instance of Cube              \           \           \
                         j*edge_length,           #                                                          \           \           \
                         i*edge_length,           #                                                           \           \           \
                         edge_length,             #                                                            \           \           \
                         edge_length,             #                                                             \           \           \
                         edge_length)             #                                                              \           \           \
            elif type==1:                         #             if type is sphere                                 \           \           \
                m = Sphere(k*edge_length,         #                 create an instance of Sphere                   } 1d array  } 2d array  } 3d array
                           j*edge_length,         #                                                               /           /           /
                           i*edge_length,         #                                                              /           /           /
                           edge_length,           #                                                             /           /           /
                           edge_length,           #                                                            /           /           /
                           edge_length,           #                                                           /           /           /
                           radius=edge_length/2)  #                                                          /           /           /
            arr1d_temp.append(m.module)           #             append the module into the list, arr1d_temp_/           /           /
        arr2d_temp.append(arr1d_temp)             #         append the arr1d_temp into the list, arr2d_temp____________/           /
    arr3d.append(arr2d_temp)                      #     append the arr2d_temp into the list, arr3d________________________________/



# visualize with grasshopper
arr3d = th.list_to_tree(arr3d)
# ---------- end array_with_class_3 ----------

data_2 = Data(array_with_class_3.arr3d)

# ----
# array with box
geometry_7 = Geometry(stream_filter)

# ----
# visualization
list_length = ListLength(List=geometry_7)
series = Series(Start=0, Step=1, Count=list_length)
gradient = Gradient(
    LowerLimit=0,
    UpperLimit=list_length,
    Parameter=series,
    stops=[0: RGB(243, 57, 0), 0.1: RGB(236, 27, 60), 0.2: RGB(210, 0, 118), 0.3: RGB(103, 0, 120), 0.4: RGB(39, 72, 161), 0.5: RGB(1, 192, 229), 0.6: RGB(18, 178, 90), 0.7: RGB(79, 186, 8), 0.8: RGB(220, 237, 32), 0.9: RGB(247, 159, 20), 1: RGB(243, 57, 0)])
duplicate_data = DuplicateData(Data=0.7, Number=list_length, Order=True)
create_material = CreateMaterial(Diffuse=gradient, Specular=RGB(255, 255, 255), Emission=RGBA(0, 0, 0, 0), Transparency=duplicate_data, Shine=0)

custom_preview = CustomPreview(Geometry=geometry_7, Material=create_material)

# ----
# Visualization
cast = BooleanToggle(True)

# ----
# Cast Concrete
cast_2 = GhPythonScript(ice=modules, x_length=x_length, y_length=y_length, z_length=z_length, edge_length=edge_length_2, cast=cast)  # -> out, bbox, concrete; inputs ice: list of Brep, x_length: Int32, y_length: Int32, z_length: Int32, cast: Boolean
# ---------- cast_2: Python ----------
# import modules
import Rhino.Geometry as rg
import Rhino.RhinoMath as rm

# set tolerance
distol = rm.ZeroTolerance

# set x, y and z interval
x_itv = rg.Interval(0, (x_length-1)*edge_length)
y_itv = rg.Interval(0, (y_length-1)*edge_length)
z_itv = rg.Interval(0, (z_length-1)*edge_length)

# create a box
bbox = rg.Box(rg.Plane.WorldXY, x_itv, y_itv, z_itv)
bbox_brep = bbox.ToBrep()

# boolean difference
if cast:
    concrete = rg.Brep.CreateBooleanDifference([bbox_brep], ice, distol)[0]
    print(concrete)
# ---------- end cast_2 ----------

value_list_4 = ValueList({"ice": 0, "concrete": 1}, selected="concrete")
data_dam = DataDam(DataConcrete=cast_2.concrete, BufferDelay=10000000, BufferMode=0)

stream_filter_2 = StreamFilter(Gate=value_list_4, Stream0=modules, Stream1=data_dam)
stream_filter_3 = StreamFilter(
    Gate=value_list_4,
    Stream0=ColourSwatch(SwatchColor=RGB(171, 196, 201)),
    Stream1=ColourSwatch(SwatchColor=RGB(148, 148, 148)))

bake = GhPythonScript(geo_to_bake=stream_filter_2, material=stream_filter_3, material_type=value_list_4, bake=Button())  # inputs geo_to_bake: list of Brep
# ---------- bake: Python ----------
##############################
####### import modules #######
##############################

# module from Rhino namespace
# https://developer.rhino3d.com/api/RhinoCommon/html/N_Rhino_Geometry.htm
import Rhino.Geometry as rg
# https://developer.rhino3d.com/api/RhinoCommon/html/N_Rhino_DocObjects.htm
import Rhino.DocObjects as rd
# https://developer.rhino3d.com/api/RhinoCommon/html/T_Rhino_RhinoDoc.htm
import Rhino.RhinoDoc as rrd

# what is scriptcontext...? The library is here in my case
# C:\Users\trtku\AppData\Roaming\McNeel\Rhinoceros\7.0\Plug-ins\IronPython\settings\lib
import scriptcontext as sc

# accessing graphic libraries
# https://docs.microsoft.com/en-us/dotnet/api/system.drawing?view=net-6.0
import System.Drawing as sd

import time

ti = time.localtime()
year = str(ti.tm_year)
month = int(ti.tm_mon)
day = str(ti.tm_mday)
if month < 10:
    month = str("0" + str(month))
prefix = (year[2:4] + "_" + month + "_" + day)

##############################
############ code ############
##############################

# get an active document
# https://developer.rhino3d.com/api/RhinoCommon/html/P_Rhino_RhinoDoc_ActiveDoc.htm
sc.doc = rrd.ActiveDoc

# bake if the button is pushed...
if bake:
    
    # iterate through the list of geometries to be baked
    for i, geo in enumerate(geo_to_bake):
        
        # initiate ObjectAttribute class
        attr = rd.ObjectAttributes()
        
        # set attributes for color
        attr.ColorSource = rd.ObjectColorSource.ColorFromObject
        attr.ObjectColor = sd.Color.FromArgb(material.A, material.R, material.G, material.B)
        
        # create layer names with prefix
        if material_type==0:
            mat = 'ice'
        else:
            mat = 'concrete'
        layer_name = prefix + '_' + mat
        
        # get a layer index for the layername
        layer_index = sc.doc.Layers.Find(layer_name, True)
        # if there is no existing layer...
        if layer_index < 0:
            # initiate layer object
            layer = rd.Layer()
            # set layer name
            layer.Name = layer_name
            # create a new layer
            layer_index = sc.doc.Layers.Add(layer)
        
        # set an attribute for layer
        attr.LayerIndex = layer_index
        
        # check if the geometry is brep class
        if type(geo)==rg.Brep:
            # bake geometry with attributes
            sc.doc.Objects.AddBrep(geo, attr)
            # print a message
            print('the geometry is successfully baked')
        
        # print a message if type is NOT brep
        else:
            # print a message
            print('{}th geometry type is NOT brep'.format(i))
# ---------- end bake ----------

custom_preview_2 = CustomPreview(Geometry=cast_2.bbox, Material=ColourSwatch(SwatchColor=RGBA(201, 171, 171, 50)))
custom_preview_3 = CustomPreview(Geometry=stream_filter_2, Material=stream_filter_3)
