# Grasshopper definition 02_module_design_custom.ghx (Grasshopper 1.0.7)
# plug-ins: Bifocals

# ----
# legend
# group of component
# input to change
# output to visuzlize
# data to pass
# copied from other file
# author: name: Ko Tsuruta
# copyright: © 2021 Ko Tsuruta
# email: trtku0809@gmail.com
# exercise
gallery = ImageGallery(
    CycleDelay=30,
    Randomize=False,
    UseLocalImages=True,
    UseRemoteImages=True,
    RemoteUrl="https://live.staticflickr.com/65535/51729808202_8bc46e4245_m.jpg")

# ----
# parameters
z_length = Slider(3, range=1..10)
x_length = Slider(5, range=1..10)
y_length = Slider(4, range=1..10)
edge_length = Slider(1, range=0.1..10)
run = BooleanToggle(False)
t_factor = Slider(1.3, range=0..2)

# ----
# parameters
z_length_2 = Slider(3, range=1..10)
x_length_2 = Slider(5, range=1..10)
y_length_2 = Slider(4, range=1..10)
edge_length_2 = Slider(1, range=0.1..10)
t_factor_2 = Slider(1.3, range=0..2)
run_2 = BooleanToggle(False)

# ----
# parameters
number_slider = Slider(4, range=1..10)
edge_length_3 = Slider(1, range=0.1..10)
list = ValueList({"Cube": 0, "Sphere": 1, "Custom": 2}, selected="Cube")
run_3 = BooleanToggle(False)
truncation = BooleanToggle(False)
t_factor_3 = Slider(0.4, range=0..2)
# 01_module_design_basic
# array with class + truncation
number_slider_2 = Slider(5, range=1..10)
number_slider_3 = Slider(3, range=1..10)

# ----
# base class
brep = Brep(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)

brep_2 = Brep(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)
brep_3 = Brep(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)
brep_4 = Brep(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)
brep_5 = Brep(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)
brep_6 = Brep(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)
brep_7 = Brep(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)
brep_8 = Brep(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)
# base class
custom = GhPythonScript(base_brep=brep_2)  # -> Custom0, module; inputs base_brep: Brep
# ---------- custom: Python ----------
import Rhino.Geometry as rg
import Rhino.RhinoMath as rm
import copy



class Custom0(object):
    
    # set class variables (=class attribute) which are shared by all the instances
    module_type = 'Custom0'
    distol = rm.DefaultDistanceToleranceMillimeters
    
    def __init__(self, x=0, y=0, z=0, edge_length_x=1, edge_length_y=1, edge_length_z=1, base_brep=base_brep):
        self.X = x
        self.Y = y
        self.Z = z
        self.edge_length_x = edge_length_x
        self.edge_length_y = edge_length_y
        self.edge_length_z = edge_length_z
        self.base_brep = base_brep
        self.color = None
        self.get_xyz_interval()
        self.draw()
    
    def get_xyz_interval(self):
        self.interval_x = rg.Interval(-self.edge_length_x/2, self.edge_length_x/2)
        self.interval_y = rg.Interval(-self.edge_length_y/2, self.edge_length_y/2)
        self.interval_z = rg.Interval(-self.edge_length_z/2, self.edge_length_z/2)
    
    def get_centroid(self):
        self.centroid = rg.Point3d(self.X, self.Y, self.Z)
        return self.centroid
    
    def get_base_plane(self):
        self.get_centroid()
        self.base_plane = rg.Plane(self.centroid, rg.Vector3d.XAxis, rg.Vector3d.YAxis)
    
    def move2grid(self):
        self.get_base_plane()
        origin = rg.Plane.WorldXY
        T = rg.Transform.PlaneToPlane(origin, self.base_plane)
        base_copy = copy.deepcopy(self.base_brep)
        base_copy.Transform(T)
        return base_copy
    
    def draw(self):
        self.module = self.move2grid()



c = Custom0(base_brep=base_brep)
module = c.module
# ---------- end custom ----------
custom_2 = GhPythonScript(base_brep=brep_3)  # -> Custom1, module; inputs base_brep: Brep
# ---------- custom_2: Python ----------
import Rhino.Geometry as rg
import Rhino.RhinoMath as rm
import copy



class Custom1(object):
    
    # set class variables (=class attribute) which are shared by all the instances
    module_type = 'Custom1'
    distol = rm.DefaultDistanceToleranceMillimeters
    
    def __init__(self, x=0, y=0, z=0, edge_length_x=1, edge_length_y=1, edge_length_z=1, base_brep=base_brep):
        self.X = x
        self.Y = y
        self.Z = z
        self.edge_length_x = edge_length_x
        self.edge_length_y = edge_length_y
        self.edge_length_z = edge_length_z
        self.base_brep = base_brep
        self.color = None
        self.get_xyz_interval()
        self.draw()
    
    def get_xyz_interval(self):
        self.interval_x = rg.Interval(-self.edge_length_x/2, self.edge_length_x/2)
        self.interval_y = rg.Interval(-self.edge_length_y/2, self.edge_length_y/2)
        self.interval_z = rg.Interval(-self.edge_length_z/2, self.edge_length_z/2)
    
    def get_centroid(self):
        self.centroid = rg.Point3d(self.X, self.Y, self.Z)
        return self.centroid
    
    def get_base_plane(self):
        self.get_centroid()
        self.base_plane = rg.Plane(self.centroid, rg.Vector3d.XAxis, rg.Vector3d.YAxis)
    
    def move2grid(self):
        self.get_base_plane()
        origin = rg.Plane.WorldXY
        T = rg.Transform.PlaneToPlane(origin, self.base_plane)
        base_copy = copy.deepcopy(self.base_brep)
        base_copy.Transform(T)
        return base_copy
    
    def draw(self):
        self.module = self.move2grid()



c = Custom1(base_brep=base_brep)
module = c.module
# ---------- end custom_2 ----------
custom_3 = GhPythonScript(base_brep=brep_4)  # -> Custom2, module; inputs base_brep: Brep
# ---------- custom_3: Python ----------
import Rhino.Geometry as rg
import Rhino.RhinoMath as rm
import copy



class Custom2(object):
    
    # set class variables (=class attribute) which are shared by all the instances
    module_type = 'Custom2'
    distol = rm.DefaultDistanceToleranceMillimeters
    
    def __init__(self, x=0, y=0, z=0, edge_length_x=1, edge_length_y=1, edge_length_z=1, base_brep=base_brep):
        self.X = x
        self.Y = y
        self.Z = z
        self.edge_length_x = edge_length_x
        self.edge_length_y = edge_length_y
        self.edge_length_z = edge_length_z
        self.base_brep = base_brep
        self.color = None
        self.get_xyz_interval()
        self.draw()
    
    def get_xyz_interval(self):
        self.interval_x = rg.Interval(-self.edge_length_x/2, self.edge_length_x/2)
        self.interval_y = rg.Interval(-self.edge_length_y/2, self.edge_length_y/2)
        self.interval_z = rg.Interval(-self.edge_length_z/2, self.edge_length_z/2)
    
    def get_centroid(self):
        self.centroid = rg.Point3d(self.X, self.Y, self.Z)
        return self.centroid
    
    def get_base_plane(self):
        self.get_centroid()
        self.base_plane = rg.Plane(self.centroid, rg.Vector3d.XAxis, rg.Vector3d.YAxis)
    
    def move2grid(self):
        self.get_base_plane()
        origin = rg.Plane.WorldXY
        T = rg.Transform.PlaneToPlane(origin, self.base_plane)
        base_copy = copy.deepcopy(self.base_brep)
        base_copy.Transform(T)
        return base_copy
    
    def draw(self):
        self.module = self.move2grid()



c = Custom2(base_brep=base_brep)
module = c.module
# ---------- end custom_3 ----------
custom_4 = GhPythonScript(base_brep=brep_5)  # -> Custom3, module; inputs base_brep: Brep
# ---------- custom_4: Python ----------
import Rhino.Geometry as rg
import Rhino.RhinoMath as rm
import copy



class Custom3(object):
    
    # set class variables (=class attribute) which are shared by all the instances
    module_type = 'Custom3'
    distol = rm.DefaultDistanceToleranceMillimeters
    
    def __init__(self, x=0, y=0, z=0, edge_length_x=1, edge_length_y=1, edge_length_z=1, base_brep=base_brep):
        self.X = x
        self.Y = y
        self.Z = z
        self.edge_length_x = edge_length_x
        self.edge_length_y = edge_length_y
        self.edge_length_z = edge_length_z
        self.base_brep = base_brep
        self.color = None
        self.get_xyz_interval()
        self.draw()
    
    def get_xyz_interval(self):
        self.interval_x = rg.Interval(-self.edge_length_x/2, self.edge_length_x/2)
        self.interval_y = rg.Interval(-self.edge_length_y/2, self.edge_length_y/2)
        self.interval_z = rg.Interval(-self.edge_length_z/2, self.edge_length_z/2)
    
    def get_centroid(self):
        self.centroid = rg.Point3d(self.X, self.Y, self.Z)
        return self.centroid
    
    def get_base_plane(self):
        self.get_centroid()
        self.base_plane = rg.Plane(self.centroid, rg.Vector3d.XAxis, rg.Vector3d.YAxis)
    
    def move2grid(self):
        self.get_base_plane()
        origin = rg.Plane.WorldXY
        T = rg.Transform.PlaneToPlane(origin, self.base_plane)
        base_copy = copy.deepcopy(self.base_brep)
        base_copy.Transform(T)
        return base_copy
    
    def draw(self):
        self.module = self.move2grid()



c = Custom3(base_brep=base_brep)
module = c.module
# ---------- end custom_4 ----------
custom_5 = GhPythonScript(base_brep=brep_6)  # -> Custom4, module; inputs base_brep: Brep
# ---------- custom_5: Python ----------
import Rhino.Geometry as rg
import Rhino.RhinoMath as rm
import copy



class Custom4(object):
    
    # set class variables (=class attribute) which are shared by all the instances
    module_type = 'Custom4'
    distol = rm.DefaultDistanceToleranceMillimeters
    
    def __init__(self, x=0, y=0, z=0, edge_length_x=1, edge_length_y=1, edge_length_z=1, base_brep=base_brep):
        self.X = x
        self.Y = y
        self.Z = z
        self.edge_length_x = edge_length_x
        self.edge_length_y = edge_length_y
        self.edge_length_z = edge_length_z
        self.base_brep = base_brep
        self.color = None
        self.get_xyz_interval()
        self.draw()
    
    def get_xyz_interval(self):
        self.interval_x = rg.Interval(-self.edge_length_x/2, self.edge_length_x/2)
        self.interval_y = rg.Interval(-self.edge_length_y/2, self.edge_length_y/2)
        self.interval_z = rg.Interval(-self.edge_length_z/2, self.edge_length_z/2)
    
    def get_centroid(self):
        self.centroid = rg.Point3d(self.X, self.Y, self.Z)
        return self.centroid
    
    def get_base_plane(self):
        self.get_centroid()
        self.base_plane = rg.Plane(self.centroid, rg.Vector3d.XAxis, rg.Vector3d.YAxis)
    
    def move2grid(self):
        self.get_base_plane()
        origin = rg.Plane.WorldXY
        T = rg.Transform.PlaneToPlane(origin, self.base_plane)
        base_copy = copy.deepcopy(self.base_brep)
        base_copy.Transform(T)
        return base_copy
    
    def draw(self):
        self.module = self.move2grid()



c = Custom4(base_brep=base_brep)
module = c.module
# ---------- end custom_5 ----------
custom_6 = GhPythonScript(base_brep=brep_7)  # -> Custom5, module; inputs base_brep: Brep
# ---------- custom_6: Python ----------
import Rhino.Geometry as rg
import Rhino.RhinoMath as rm
import copy



class Custom5(object):
    
    # set class variables (=class attribute) which are shared by all the instances
    module_type = 'Custom5'
    distol = rm.DefaultDistanceToleranceMillimeters
    
    def __init__(self, x=0, y=0, z=0, edge_length_x=1, edge_length_y=1, edge_length_z=1, base_brep=base_brep):
        self.X = x
        self.Y = y
        self.Z = z
        self.edge_length_x = edge_length_x
        self.edge_length_y = edge_length_y
        self.edge_length_z = edge_length_z
        self.base_brep = base_brep
        self.color = None
        self.get_xyz_interval()
        self.draw()
    
    def get_xyz_interval(self):
        self.interval_x = rg.Interval(-self.edge_length_x/2, self.edge_length_x/2)
        self.interval_y = rg.Interval(-self.edge_length_y/2, self.edge_length_y/2)
        self.interval_z = rg.Interval(-self.edge_length_z/2, self.edge_length_z/2)
    
    def get_centroid(self):
        self.centroid = rg.Point3d(self.X, self.Y, self.Z)
        return self.centroid
    
    def get_base_plane(self):
        self.get_centroid()
        self.base_plane = rg.Plane(self.centroid, rg.Vector3d.XAxis, rg.Vector3d.YAxis)
    
    def move2grid(self):
        self.get_base_plane()
        origin = rg.Plane.WorldXY
        T = rg.Transform.PlaneToPlane(origin, self.base_plane)
        base_copy = copy.deepcopy(self.base_brep)
        base_copy.Transform(T)
        return base_copy
    
    def draw(self):
        self.module = self.move2grid()



c = Custom5(base_brep=base_brep)
module = c.module
# ---------- end custom_6 ----------
custom_7 = GhPythonScript(base_brep=brep_8)  # -> Custom6, module; inputs base_brep: Brep
# ---------- custom_7: Python ----------
import Rhino.Geometry as rg
import Rhino.RhinoMath as rm
import copy



class Custom6(object):
    
    # set class variables (=class attribute) which are shared by all the instances
    module_type = 'Custom6'
    distol = rm.DefaultDistanceToleranceMillimeters
    
    def __init__(self, x=0, y=0, z=0, edge_length_x=1, edge_length_y=1, edge_length_z=1, base_brep=base_brep):
        self.X = x
        self.Y = y
        self.Z = z
        self.edge_length_x = edge_length_x
        self.edge_length_y = edge_length_y
        self.edge_length_z = edge_length_z
        self.base_brep = base_brep
        self.color = None
        self.get_xyz_interval()
        self.draw()
    
    def get_xyz_interval(self):
        self.interval_x = rg.Interval(-self.edge_length_x/2, self.edge_length_x/2)
        self.interval_y = rg.Interval(-self.edge_length_y/2, self.edge_length_y/2)
        self.interval_z = rg.Interval(-self.edge_length_z/2, self.edge_length_z/2)
    
    def get_centroid(self):
        self.centroid = rg.Point3d(self.X, self.Y, self.Z)
        return self.centroid
    
    def get_base_plane(self):
        self.get_centroid()
        self.base_plane = rg.Plane(self.centroid, rg.Vector3d.XAxis, rg.Vector3d.YAxis)
    
    def move2grid(self):
        self.get_base_plane()
        origin = rg.Plane.WorldXY
        T = rg.Transform.PlaneToPlane(origin, self.base_plane)
        base_copy = copy.deepcopy(self.base_brep)
        base_copy.Transform(T)
        return base_copy
    
    def draw(self):
        self.module = self.move2grid()



c = Custom6(base_brep=base_brep)
module = c.module
# ---------- end custom_7 ----------

cube = GhPythonScript(t_factor=t_factor_3)  # -> Cube, module, t_module
# ---------- cube: Python ----------
# import module
import Rhino.Geometry as rg
import Rhino.RhinoMath as rm  # module to get minimum tolerance in rhino



# create a class for module
class Cube(object):
    
    # set class variables (=class attribute) which are shared by all the instances
    module_type = 'cube'
    distol = rm.DefaultDistanceToleranceMillimeters
    
    # initialize method with arguments
    def __init__(self, x=0, y=0, z=0, edge_length_x=1, edge_length_y=1, edge_length_z=1):
        self.X = x
        self.Y = y
        self.Z = z
        self.edge_length_x = edge_length_x
        self.edge_length_y = edge_length_y
        self.edge_length_z = edge_length_z
        self.color = None
        self.draw()
        self.to_brep()
    
    # a method to get interval in x, y and z direction
    def get_xyz_interval(self):
        self.interval_x = rg.Interval(-self.edge_length_x/2, self.edge_length_x/2)
        self.interval_y = rg.Interval(-self.edge_length_y/2, self.edge_length_y/2)
        self.interval_z = rg.Interval(-self.edge_length_z/2, self.edge_length_z/2)
    
    # a method to get centroid with instance variables
    def get_centroid(self):
        self.centroid = rg.Point3d(self.X, self.Y, self.Z)
    
    # a method to get base plane around the centroid
    def get_base_plane(self):
        self.get_centroid()
        self.base_plane = rg.Plane(self.centroid, rg.Vector3d.XAxis, rg.Vector3d.YAxis)
    
    # a method to get an actual geometry of the module
    def draw(self):
        self.get_base_plane()
        self.get_xyz_interval()
        box = rg.Box(self.base_plane, self.interval_x, self.interval_y, self.interval_z)
        self.module = box
    
    ##############################
    ### methods for truncation ###
    ##############################
    
    # a method to translate a structure to brep
    def to_brep(self):                           # name method with an argument
        self.module_brep = self.module.ToBrep()  # set the brep as an attributes
    
    # a method to get vertices of the box
    def get_vertices(self):                       # name method with an argument
        verts = self.module_brep.Vertices         # get vertices from box structure
        self.verts = [v.Location for v in verts]  # get actual point geometry from rg.BrepVertex to rg.Point3d
    
    # a method to calculate vectors from centroid to vertices
    def calc_vecs_center2verts(self):                                              # name method with an argument, verts
        self.get_vertices()                                                        # get vertices
        self.center2verts =  [rg.Vector3d(p - self.centroid) for p in self.verts]  # set a list of rg.Vector3d as an attribute
    
    # a method to create planes around vetices
    def create_corner_planes(self):                                             # name method with arguments, verts, vecs
        self.calc_vecs_center2verts()                                           # calculate vectors from centroid to corners
        return [rg.Plane(p, v) for p, v in zip(self.verts, self.center2verts)]  # return a list of rg.Plane
    
    # a method to move planes towards centroid
    def pull_corner_planes(self, pull_factor):              # name method with an arguments, pull_factor
        corner_planes = self.create_corner_planes()         # get planes around corners
        cutter_planes = []                                  # create an empty list
        for p, v in zip(corner_planes, self.center2verts):  # iterate through planes and vectors, from calc_vecs_center2verts and create_corner_planes
            pull_vec = v * pull_factor * (-1)               #     scale the vector according to pull_factor
            T = rg.Transform.Translation(pull_vec)          #     calculate transformation matrix
            p_transformed = p.Clone()                       #     create a deep copy of the plane
            p_transformed.Transform(T)                      #     transform the copied plane
            cutter_planes.append(p_transformed)             #     append the plane into the list, cutter_planes
        return cutter_planes                                # return the list of rg.Planes
    
    # a method to get doubled interval
    def get_double_interval(self, interval):      # name the method with an argument, interval
        new_max = interval.Mid + interval.Length  # calculate new max
        new_min = interval.Mid - interval.Length  # calculate new min
        new_itv = rg.Interval(new_min, new_max)   # create an interval
        return new_itv                            # return the interval
    
    # a method to create a list of surfaces with planes
    def create_cutter(self, pull_factor):                                       # name the method with an argument, pull_factor
        cutter_planes = self.pull_corner_planes(pull_factor)                    # create cutter planes
        itv_x = self.get_double_interval(self.interval_x)                       # get doubled x_interval
        itv_y = self.get_double_interval(self.interval_y)                       # get doubled y_interval
        cutters = []                                                            # create an empty list
        for p in cutter_planes:                                                 # iterate through cutter_planes
            cutter_outline = rg.Rectangle3d(p, itv_x, itv_y)                    #     create a rectangle around the corner plane
            cutter_outline = cutter_outline.ToNurbsCurve()                      #     translate rg.Rectangle3d into rg.NurbsCurve
            cutter = rg.Brep.CreatePlanarBreps(cutter_outline, self.distol)[0]  #     create a brep based on the rectangle
            cutters.append(cutter)                                              #     append the brep into the list, cutters
        return cutters                                                          # return the list
    
    # a method to truncate(cut) the module
    def truncation(self, pull_factor):                                                                  # name method with argument, pull_factor
        if pull_factor == 0:                                                                            # no truncation if the pull_factor is zero
            print('There is no truncation (factor=0)')                                                  #     print a message
        else:                                                                                           # truncation if the pull_factor is NOT zero
            cutters = self.create_cutter(pull_factor)                                                   #     create cutters for truncation
            for i, c in enumerate(cutters):                                                                           #     iterate through the cutters
                try:                                                                                    #         try...
                    self.module_brep = rg.Brep.CreateBooleanSplit(self.module_brep, c, self.distol)[0]  #             try boolean split(success if there's proper intersection)
                except:                                                                                 #         except...
                    print('There is no intersection at {}th cutter'.format(i))                          #             print a message



# create an instance of Cube for test
c = Cube()
c.truncation(t_factor)
module = c.module
t_module = c.module_brep
# ---------- end cube ----------
sphere = GhPythonScript(t_factor=t_factor_3)  # -> Sphere, module, t_module
# ---------- sphere: Python ----------
import Rhino.Geometry as rg
import Rhino.RhinoMath as rm
import copy as c



# create a class for module
class Sphere(object):
    
    # set class variables (=class attribute) which are shared by all the instances
    module_type = 'sphere'
    distol = rm.DefaultDistanceToleranceMillimeters
    
    # initialize method with arguments
    def __init__(self, x=0, y=0, z=0, edge_length_x=1, edge_length_y=1, edge_length_z=1, radius=.5):
        self.X = x
        self.Y = y
        self.Z = z
        self.R = radius
        self.edge_length_x = edge_length_x
        self.edge_length_y = edge_length_y
        self.edge_length_z = edge_length_z
        self.color = None
        self.get_xyz_interval()
        self.draw()
        self.module_brep = self.to_brep(self.module)
    
    # a method to get interval in x, y and z direction
    def get_xyz_interval(self):
        self.interval_x = rg.Interval(-self.edge_length_x/2, self.edge_length_x/2)
        self.interval_y = rg.Interval(-self.edge_length_y/2, self.edge_length_y/2)
        self.interval_z = rg.Interval(-self.edge_length_z/2, self.edge_length_z/2)
    
    # a method to get centroid with instance variables
    def get_centroid(self):
        self.centroid = rg.Point3d(self.X, self.Y, self.Z)
    
    # a method to get base plane around the centroid
    def get_base_plane(self):
        self.get_centroid()
        self.base_plane = rg.Plane(self.centroid, rg.Vector3d.XAxis, rg.Vector3d.YAxis)
    
    # a method to get an actual geometry of the module
    def draw(self):
        self.get_base_plane()
        self.module = rg.Sphere(self.base_plane.Origin, self.R)
    
    ##############################
    ### methods for truncation ###
    ##############################
    
    # a method to translate a structure to brep
    def to_brep(self, geo):  # name method with an argument, geo
        return geo.ToBrep()  # return the brep
    
    # a method to create scaled module
    def scale_truncation(self, pull_factor):                                            # name method with an argument, pull_factor
        S = rg.Transform.Scale(self.base_plane, pull_factor, pull_factor, pull_factor)  # calculate a transformation matrix
        m_copy = c.deepcopy(self.module)                                                # create a deep copy of the module
        m_copy.Transform(S)                                                             # transform the copied module
        return m_copy                                                                   # return the transformed module
    
    # a method to get bounding box of the sphere
    def get_bbox(self):                                                                    # nema method with no argument
        bbox = rg.Box(self.base_plane, self.interval_x, self.interval_y, self.interval_z)  # create a box which inscribe the module
        return bbox                                                                        # return the box
    
    # a method to truncate(cut) the module
    def truncation(self, pull_factor):
        scaled_m = self.scale_truncation(pull_factor)                                                              # scale the module
        self.module_brep = self.to_brep(scaled_m)                                                                  # translate the module into brep
        if pull_factor <= 1:                                                                                       # no truncation if the pull_factor is zero
            print('There is no truncation (factor<=1)')                                                            #     print a message
        else:                                                                                                      # truncation if the pull_factor is NOT zero
            bbox = self.get_bbox()                                                                                 #     get the bounding box
            bbox_brep = self.to_brep(bbox)                                                                         #     translate the bbox into brep
            try:                                                                                                   #     try...
                self.module_brep = rg.Brep.CreateBooleanIntersection(self.module_brep, bbox_brep, self.distol)[0]  #         try boolean intersection
            except:                                                                                                #     except...
                self.module_brep = bbox_brep                                                                       #         use bbox as module_brep
                print('There is no intersection')                                                                  #         print a message



# create an instance of Sphere for test
s = Sphere()
s.truncation(t_factor)
module = s.module
t_module = s.module_brep
print(s.interval_x)
# ---------- end sphere ----------
geo = Geometry(cube.module)
geo_2 = Geometry(cube.t_module)
geo_3 = Geometry(sphere.module)
geo_4 = Geometry(sphere.t_module)

# ----
# custom module
# base class
brep_9 = Brep(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)
custom_8 = GhPythonScript(base_brep=brep_9)  # -> Custom, module; inputs base_brep: Brep
# ---------- custom_8: Python ----------
import Rhino.Geometry as rg
import Rhino.RhinoMath as rm
import copy



class Custom(object):
    
    # set class variables (=class attribute) which are shared by all the instances
    module_type = 'custom'
    distol = rm.DefaultDistanceToleranceMillimeters
    
    def __init__(self, x=0, y=0, z=0, edge_length_x=1, edge_length_y=1, edge_length_z=1, base_brep=base_brep):
        self.X = x
        self.Y = y
        self.Z = z
        self.edge_length_x = edge_length_x
        self.edge_length_y = edge_length_y
        self.edge_length_z = edge_length_z
        self.base_brep = base_brep
        self.color = None
        self.get_xyz_interval()
        self.draw()
    
    def get_xyz_interval(self):
        self.interval_x = rg.Interval(-self.edge_length_x/2, self.edge_length_x/2)
        self.interval_y = rg.Interval(-self.edge_length_y/2, self.edge_length_y/2)
        self.interval_z = rg.Interval(-self.edge_length_z/2, self.edge_length_z/2)
    
    def get_centroid(self):
        self.centroid = rg.Point3d(self.X, self.Y, self.Z)
        return self.centroid
    
    def get_base_plane(self):
        self.get_centroid()
        self.base_plane = rg.Plane(self.centroid, rg.Vector3d.XAxis, rg.Vector3d.YAxis)
    
    # method to move the original module to grid
    def move2grid(self):                                        # name the method without argument
        origin = rg.Plane.WorldXY                               # get the original plane at 0,0,0
        self.get_base_plane()                                   # get base plane
        T = rg.Transform.PlaneToPlane(origin, self.base_plane)  # calculate transformation matrix
        base_copy = copy.deepcopy(self.base_brep)               # copy the module
        base_copy.Transform(T)                                  # transform(move) the copied module
        return base_copy                                        # return the moved module
    
    # a method to draw
    def draw(self):                                        # name method without argument
        self.module = self.module_brep = self.move2grid()  # set module and module_brep as same data, transformed base_brep
    
    def truncation(self, _):  # fake method
        pass



# create an instance of Custom for test
c = Custom(base_brep=base_brep)
module = c.module
# ---------- end custom_8 ----------
geo_5 = Geometry(custom_8.module)

cube_2 = Data(cube.Cube)
sphere_2 = Data(sphere.Sphere)
geo_6 = Geometry(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)
custom_9 = Data(custom_8.Custom)
brep_10 = Brep(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)
geo_7 = Geometry(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)
cylinder = GhPythonScript(base_brep=brep)  # -> Cylinder, module; inputs base_brep: Brep
# ---------- cylinder: Python ----------
import Rhino.Geometry as rg
import Rhino.RhinoMath as rm
import copy



class Cylinder(object):
    
    # set class variables (=class attribute) which are shared by all the instances
    module_type = 'Cylinder'
    distol = rm.DefaultDistanceToleranceMillimeters
    
    def __init__(self, x=0, y=0, z=0, edge_length_x=1, edge_length_y=1, edge_length_z=1, base_brep=base_brep):
        self.X = x
        self.Y = y
        self.Z = z
        self.edge_length_x = edge_length_x
        self.edge_length_y = edge_length_y
        self.edge_length_z = edge_length_z
        self.base_brep = base_brep
        self.color = None
        self.get_xyz_interval()
        self.draw()
    
    def get_xyz_interval(self):
        self.interval_x = rg.Interval(-self.edge_length_x/2, self.edge_length_x/2)
        self.interval_y = rg.Interval(-self.edge_length_y/2, self.edge_length_y/2)
        self.interval_z = rg.Interval(-self.edge_length_z/2, self.edge_length_z/2)
    
    def get_centroid(self):
        self.centroid = rg.Point3d(self.X, self.Y, self.Z)
        return self.centroid
    
    def get_base_plane(self):
        self.get_centroid()
        self.base_plane = rg.Plane(self.centroid, rg.Vector3d.XAxis, rg.Vector3d.YAxis)
    
    def move2grid(self):
        self.get_base_plane()
        origin = rg.Plane.WorldXY
        T = rg.Transform.PlaneToPlane(origin, self.base_plane)
        base_copy = copy.deepcopy(self.base_brep)
        base_copy.Transform(T)
        return base_copy
    
    def draw(self):
        self.module = self.move2grid()



c = Cylinder(base_brep=base_brep)
module = c.module
# ---------- end cylinder ----------
cone = GhPythonScript(base_brep=brep_10)  # -> Cone, module; inputs base_brep: Brep
# ---------- cone: Python ----------
import Rhino.Geometry as rg
import Rhino.RhinoMath as rm
import copy



class Cone(object):
    
    # set class variables (=class attribute) which are shared by all the instances
    module_type = 'Cone'
    distol = rm.DefaultDistanceToleranceMillimeters
    
    def __init__(self, x=0, y=0, z=0, edge_length_x=1, edge_length_y=1, edge_length_z=1, base_brep=base_brep):
        self.X = x
        self.Y = y
        self.Z = z
        self.edge_length_x = edge_length_x
        self.edge_length_y = edge_length_y
        self.edge_length_z = edge_length_z
        self.base_brep = base_brep
        self.color = None
        self.get_xyz_interval()
        self.draw()
    
    def get_xyz_interval(self):
        self.interval_x = rg.Interval(-self.edge_length_x/2, self.edge_length_x/2)
        self.interval_y = rg.Interval(-self.edge_length_y/2, self.edge_length_y/2)
        self.interval_z = rg.Interval(-self.edge_length_z/2, self.edge_length_z/2)
    
    def get_centroid(self):
        self.centroid = rg.Point3d(self.X, self.Y, self.Z)
        return self.centroid
    
    def get_base_plane(self):
        self.get_centroid()
        self.base_plane = rg.Plane(self.centroid, rg.Vector3d.XAxis, rg.Vector3d.YAxis)
    
    def move2grid(self):
        self.get_base_plane()
        origin = rg.Plane.WorldXY
        T = rg.Transform.PlaneToPlane(origin, self.base_plane)
        base_copy = copy.deepcopy(self.base_brep)
        base_copy.Transform(T)
        return base_copy
    
    def draw(self):
        self.module = self.move2grid()




c = Cone(base_brep=base_brep)
module = c.module
# ---------- end cone ----------
tcube = GhPythonScript(base_brep=geo_6)  # -> Tcube, module; inputs base_brep: Brep
# ---------- tcube: Python ----------
import Rhino.Geometry as rg
import Rhino.RhinoMath as rm
import copy



class Tcube(object):
    
    # set class variables (=class attribute) which are shared by all the instances
    module_type = 'Tcube'
    distol = rm.DefaultDistanceToleranceMillimeters
    
    def __init__(self, x=0, y=0, z=0, edge_length_x=1, edge_length_y=1, edge_length_z=1, base_brep=base_brep):
        self.X = x
        self.Y = y
        self.Z = z
        self.edge_length_x = edge_length_x
        self.edge_length_y = edge_length_y
        self.edge_length_z = edge_length_z
        self.base_brep = base_brep
        self.color = None
        self.get_xyz_interval()
        self.draw()
    
    def get_xyz_interval(self):
        self.interval_x = rg.Interval(-self.edge_length_x/2, self.edge_length_x/2)
        self.interval_y = rg.Interval(-self.edge_length_y/2, self.edge_length_y/2)
        self.interval_z = rg.Interval(-self.edge_length_z/2, self.edge_length_z/2)
    
    def get_centroid(self):
        self.centroid = rg.Point3d(self.X, self.Y, self.Z)
        return self.centroid
    
    def get_base_plane(self):
        self.get_centroid()
        self.base_plane = rg.Plane(self.centroid, rg.Vector3d.XAxis, rg.Vector3d.YAxis)
    
    def move2grid(self):
        self.get_base_plane()
        origin = rg.Plane.WorldXY
        T = rg.Transform.PlaneToPlane(origin, self.base_plane)
        base_copy = copy.deepcopy(self.base_brep)
        base_copy.Transform(T)
        return base_copy
    
    def draw(self):
        self.module = self.move2grid()



c = Tcube(base_brep=base_brep)
module = c.module
# ---------- end tcube ----------
tsphere = GhPythonScript(base_brep=geo_7)  # -> Tsphere, module; inputs base_brep: Brep
# ---------- tsphere: Python ----------
import Rhino.Geometry as rg
import Rhino.RhinoMath as rm
import copy



class Tsphere(object):
    
    # set class variables (=class attribute) which are shared by all the instances
    module_type = 'Tsphere'
    distol = rm.DefaultDistanceToleranceMillimeters
    
    def __init__(self, x=0, y=0, z=0, edge_length_x=1, edge_length_y=1, edge_length_z=1, base_brep=base_brep):
        self.X = x
        self.Y = y
        self.Z = z
        self.edge_length_x = edge_length_x
        self.edge_length_y = edge_length_y
        self.edge_length_z = edge_length_z
        self.base_brep = base_brep
        self.color = None
        self.get_xyz_interval()
        self.draw()
    
    def get_xyz_interval(self):
        self.interval_x = rg.Interval(-self.edge_length_x/2, self.edge_length_x/2)
        self.interval_y = rg.Interval(-self.edge_length_y/2, self.edge_length_y/2)
        self.interval_z = rg.Interval(-self.edge_length_z/2, self.edge_length_z/2)
    
    def get_centroid(self):
        self.centroid = rg.Point3d(self.X, self.Y, self.Z)
        return self.centroid
    
    def get_base_plane(self):
        self.get_centroid()
        self.base_plane = rg.Plane(self.centroid, rg.Vector3d.XAxis, rg.Vector3d.YAxis)
    
    def move2grid(self):
        self.get_base_plane()
        origin = rg.Plane.WorldXY
        T = rg.Transform.PlaneToPlane(origin, self.base_plane)
        base_copy = copy.deepcopy(self.base_brep)
        base_copy.Transform(T)
        return base_copy
    
    def draw(self):
        self.module = self.move2grid()



c = Tsphere(base_brep=base_brep)
module = c.module
# ---------- end tsphere ----------

# ----
# base grid
array_with_class = GhPythonScript(
    x_length=number_slider_2,
    y_length=number_slider,
    z_length=number_slider_3,
    edge_length=edge_length_3,
    type=list,
    run=run_3,
    truncation=truncation,
    t_factor=t_factor_3,
    Cube=cube.Cube,
    Sphere=sphere.Sphere,
    Custom=custom_8.Custom)  # -> out, arr3d, m; inputs x_length: Int32, y_length: Int32, z_length: Int32, run: Boolean, truncation: Boolean
# ---------- array_with_class: Python ----------
'''
ABOUT:
This is a file explaining about array with geometry using class

'''



# import module
import Rhino.Geometry as rg          # for geometrical operation using Rhino.Geometry namaspace
import ghpythonlib.treehelpers as th # for data translation between python-list and gh-tree



# 3d array with geometry
if run:
    arr3d = []                                        # create an empty list, arr3d_______________________________________________________
    for i in range(z_length):                         # iterate through z_length                                                          \
        arr2d_temp = []                               #     create an empty list, arr2d_temp____________________________________           \
        for j in range(y_length):                     #     iterate through y_length                                            \           \
            arr1d_temp = []                           #         create an empty list, arr2d_temp______________________           \           \
            for k in range(x_length):                 #         iterate through x_length                              \           \           \
                print('\nshowing module at index(x:{}, y:{}, z:{})'.format(k, j, i))                                  #\           \           \
                if type==0:                           #             if type is cube                                     \           \           \
                    m = Cube(k*edge_length,           #                 create an instance of Cube                       \           \           \
                             j*edge_length,           #                                                                   \           \           \
                             i*edge_length,           #                                                                    \           \           \
                             edge_length,             #                                                                     \           \           \
                             edge_length,             #                                                                      \           \           \
                             edge_length)             #                                                                       \           \           \
                elif type==1:                         #             if type is sphere                                          \           \           \
                    m = Sphere(k*edge_length,         #                 create an instance of Sphere                            } 1d array  } 2d array  } 3d array
                               j*edge_length,         #                                                                        /           /           /
                               i*edge_length,         #                                                                       /           /           /
                               edge_length,           #                                                                      /           /           /
                               edge_length,           #                                                                     /           /           /
                               edge_length,           #                                                                    /           /           /
                               radius=edge_length/2)  #                                                                   /           /           /
                elif type==2:                         #             if type is custum                                    /           /           /
                    m = Custom(k*edge_length,         #                 create an instance of Custom                    /           /           /
                               j*edge_length,         #                                                                /           /           /
                               i*edge_length,         #                                                               /           /           /
                               edge_length,           #                                                              /           /           /
                               edge_length,           #                                                             /           /           /
                               edge_length)           #                                                            /           /           /
                if truncation:                        #             if truncation...                              /           /           /
                    m.truncation(t_factor)            #                 do truncation                            /           /           /
                arr1d_temp.append(m.module_brep)      #             append the module into the list, arr1d_temp_/           /           /
            arr2d_temp.append(arr1d_temp)             #         append the arr1d_temp into the list, arr2d_temp____________/           /
        arr3d.append(arr2d_temp)                      #     append the arr2d_temp into the list, arr3d________________________________/
    
    
    
    # visualize with grasshopper
    arr3d = th.list_to_tree(arr3d)
# ---------- end array_with_class ----------

modules = Geometry(flatten(array_with_class.arr3d))
edge_length_4 = Number(edge_length_3)
y_length_3 = Number(number_slider)
x_length_3 = Number(number_slider_2)
z_length_3 = Number(number_slider_3)

data = Data(array_with_class.m)

dam = DataDam(DataModule=data, BufferDelay=10000000, BufferMode=0)
export = BooleanToggle(False)

# ----
# boundary condition
neighbor_check = GhPythonScript(x_length=x_length, y_length=y_length, z_length=z_length)  # -> out, arr3d; inputs x_length: Int32, y_length: Int32, z_length: Int32
# ---------- neighbor_check: Python ----------
##############################
####### import modules #######
##############################

import Rhino.Geometry as rg          # for geometrical operation using Rhino.Geometry namaspace
import ghpythonlib.treehelpers as th # for data translation between python-list and gh-tree
import random as r                   # random number generator
r.seed(0)                            # set a seed to avoid randomization in every execution
import copy                          # copy-related functions

##############################
########## function ##########
##############################

def get_neighbor_index(ind, list_length):  # name a function with arguments
    if ind == 0:                           # if the ind equal to zero...
        n_ind = [ind+1]                    #     neighboring index is ind+1 (one next)
    elif ind == (list_length-1):           # if the ind equal to the length of the array...
        n_ind = [ind-1]                    #     neighboring index is ind-1 (one back)
    else:                                  # if the ind is inbetween...
        n_ind = [ind-1, ind+1]             #     neighboring index is ind-1 and ind+1 (both back and next)
    return n_ind                           # return the neighboring index

def get_substitution(ind):                 # name a function with an argument 
    indices = [0,1,2,3,4,5,6]              # set a list of numbers on behalf of a list of modules
    indices.remove(ind)                    # remove the item, ind, from the list
    substitute = indices[r.randint(0, 5)]  # pick up a random item from the list
    return substitute                      # return the picked up item

def check_neighbor(arr3d_init, i, j, k, x_length, y_length, z_length):
    item = arr3d_init[i][j][k]                                 #         get the current item to check
    
    x_neighbor = get_neighbor_index(k, x_length)               #         get the neighbor index in x direction
    y_neighbor = get_neighbor_index(j, y_length)               #         get the neighbor index in y direction
    z_neighbor = get_neighbor_index(i, z_length)               #         get the neighbor index in z direction
    
    for x_ind in x_neighbor:                                   #         iterate through the x direction neighbors
        if item == arr3d_init[i][j][x_ind]:                    #             if the current item and neighbor are same...
            arr3d_init[i][j][x_ind] = get_substitution(x_ind)  #                 replace
    
    for y_ind in y_neighbor:                                   #         iterate through the y direction neighbors
        if item == arr3d_init[i][y_ind][k]:                    #             if the current item and neighbor are same...
            arr3d_init[i][y_ind][k] = get_substitution(y_ind)  #                 replace
    
    for z_ind in z_neighbor:                                   #         iterate through the z direction neighbors
        if item == arr3d_init[z_ind][j][k]:                    #             if the current item and neighbor are same...
            arr3d_init[z_ind][j][k] = get_substitution(z_ind)  #                 replace
    
    return arr3d_init

##############################
############ code ############
##############################

# initialize arr3d with random numbers
arr3d_init = [[[r.randint(0, 6) for k in range(x_length)] for j in range(y_length)] for i in range(z_length)]

# neighbor check
for i, arr2d in enumerate(arr3d_init):                                         # iterate through the arr3d
    for j, arr1d in enumerate(arr2d):                                          #     iterate through the arr2d
        for k, item in enumerate(arr1d):                                       #         iterate through the arr1d
            check_neighbor(arr3d_init, i, j, k, x_length, y_length, z_length)  #             check the neighbor

arr3d = th.list_to_tree(arr3d_init)
# ---------- end neighbor_check ----------

# ----
# base grid
array_with_class_2 = GhPythonScript(
    arr3d_init=neighbor_check.arr3d,
    edge_length=edge_length,
    run=run,
    t_factor=t_factor,
    Custom0=custom.Custom0,
    Custom1=custom_2.Custom1,
    Custom2=custom_3.Custom2,
    Custom3=custom_4.Custom3,
    Custom4=custom_5.Custom4,
    Custom5=custom_6.Custom5,
    Custom6=custom_7.Custom6)  # -> out, arr3d; inputs arr3d_init: tree of Int32, run: Boolean
# ---------- array_with_class_2: Python ----------
##############################
####### import modules #######
##############################

import Rhino.Geometry as rg          # for geometrical operation using Rhino.Geometry namaspace
import ghpythonlib.treehelpers as th # for data translation between python-list and gh-tree
import System.Drawing as sd

##############################
########## function ##########
##############################

def remap_value(value, oriMin, oriMax, toMin=0, toMax=1):
    delta = oriMax - oriMin
    deltaTarget = toMax - toMin
    newValue = toMin + (value-oriMin) * deltaTarget / delta
    return newValue

##############################
############ code ############
##############################

arr3d_init = th.tree_to_list(arr3d_init)

# 3d array with box
if run:
    arr3d = []
    for i, arr2d_init in enumerate(arr3d_init):
        arr2d_temp = []
        for j, arr1d_init in enumerate(arr2d_init):
            arr1d_temp = []
            for k, label in enumerate(arr1d_init):
                if label == 0:
                    m = Custom0(k*edge_length,
                                j*edge_length,
                                i*edge_length,
                                edge_length,
                                edge_length,
                                edge_length)
                elif label == 1:
                    m = Custom1(k*edge_length,
                               j*edge_length,
                               i*edge_length,
                               edge_length,
                               edge_length,
                               edge_length)
                elif label == 2:
                    m = Custom2(k*edge_length,
                                j*edge_length,
                                i*edge_length,
                                edge_length,
                                edge_length,
                                edge_length)
                elif label == 3:
                    m = Custom3(k*edge_length,
                                j*edge_length,
                                i*edge_length,
                                edge_length,
                                edge_length,
                               edge_length)
                elif label == 4:
                    m = Custom4(k*edge_length,
                                j*edge_length,
                                i*edge_length,
                                edge_length,
                                edge_length,
                                edge_length)
                elif label == 5:
                    m = Custom5(k*edge_length,
                                j*edge_length,
                                i*edge_length,
                                edge_length,
                                edge_length,
                                edge_length)
                elif label == 6:
                    m = Custom6(k*edge_length,
                                j*edge_length,
                                i*edge_length,
                                edge_length,
                                edge_length,
                                edge_length)
                
                col = remap_value(label, 0, 6, 50, 255)
                m.color = sd.Color.FromArgb(255, col, col, col)
                
                arr1d_temp.append([m.module, m.color])
            arr2d_temp.append(arr1d_temp)
        arr3d.append(arr2d_temp)
    
    # visualize with grasshopper
    arr3d = th.list_to_tree(arr3d)
# ---------- end array_with_class_2 ----------

data_2 = Data(array_with_class_2.arr3d)
item = ListItem(List=data_2, Index=0, Wrap=True)  # -> Item, Item1
preview = CustomPreview(Geometry=item.Item, Material=item.Item1)

# ----
# custom module + neighbor check
neighbor_check_2 = GhPythonScript(x_length=x_length_2, y_length=y_length_2, z_length=z_length_2)  # -> out, arr3d; inputs x_length: Int32, y_length: Int32, z_length: Int32; same code as neighbor_check

# ----
# base grid
array_with_class_3 = GhPythonScript(
    arr3d_init=neighbor_check_2.arr3d,
    edge_length=edge_length_2,
    run=run_2,
    t_factor=t_factor_2,
    Cube=cube_2,
    Sphere=sphere_2,
    Custom=custom_9,
    Cylinder=cylinder.Cylinder,
    Cone=cone.Cone,
    Tcube=tcube.Tcube,
    Tsphere=tsphere.Tsphere)  # -> out, arr3d; inputs arr3d_init: tree of Int32, run: Boolean
# ---------- array_with_class_3: Python ----------
##############################
####### import modules #######
##############################

import Rhino.Geometry as rg          # for geometrical operation using Rhino.Geometry namaspace
import ghpythonlib.treehelpers as th # for data translation between python-list and gh-tree
import System.Drawing as sd

##############################
########## function ##########
##############################

def remap_value(value, oriMin, oriMax, toMin=0, toMax=1):
    delta = oriMax - oriMin
    deltaTarget = toMax - toMin
    newValue = toMin + (value-oriMin) * deltaTarget / delta
    return newValue

##############################
############ code ############
##############################

arr3d_init = th.tree_to_list(arr3d_init)

# 3d array with box
if run:
    arr3d = []
    for i, arr2d_init in enumerate(arr3d_init):
        arr2d_temp = []
        for j, arr1d_init in enumerate(arr2d_init):
            arr1d_temp = []
            for k, label in enumerate(arr1d_init):
                if label == 0:
                    m = Cube(k*edge_length,
                             j*edge_length,
                             i*edge_length,
                             edge_length,
                             edge_length,
                             edge_length)
                elif label == 1:
                    m = Sphere(k*edge_length,
                               j*edge_length,
                               i*edge_length,
                               edge_length,
                               edge_length,
                               edge_length,
                               radius=edge_length/2)
                elif label == 2:
                    m = Custom(k*edge_length,
                               j*edge_length,
                               i*edge_length,
                               edge_length,
                               edge_length,
                               edge_length)
                elif label == 3:
                    m = Cylinder(k*edge_length,
                               j*edge_length,
                               i*edge_length,
                               edge_length,
                               edge_length,
                               edge_length)
                elif label == 4:
                    m = Cone(k*edge_length,
                               j*edge_length,
                               i*edge_length,
                               edge_length,
                               edge_length,
                               edge_length)
                elif label == 5:
                    m = Tcube(k*edge_length,
                               j*edge_length,
                               i*edge_length,
                               edge_length,
                               edge_length,
                               edge_length)
                elif label == 6:
                    m = Tsphere(k*edge_length,
                               j*edge_length,
                               i*edge_length,
                               edge_length,
                               edge_length,
                               edge_length)
                
                col = remap_value(label, 0, 6, 50, 255)
                m.color = sd.Color.FromArgb(255, col, col, col)
                
                arr1d_temp.append([m.module, m.color])
            arr2d_temp.append(arr1d_temp)
        arr3d.append(arr2d_temp)
    
    # visualize with grasshopper
    arr3d = th.list_to_tree(arr3d)
# ---------- end array_with_class_3 ----------

data_3 = Data(array_with_class_3.arr3d)

item_2 = ListItem(List=data_3, Index=0, Wrap=True)  # -> Item, Item1
preview_2 = CustomPreview(Geometry=item_2.Item, Material=item_2.Item1)

# ----
# Visualization
cast = BooleanToggle(False)

# ----
# Cast Concrete
cast_2 = GhPythonScript(
    ice=flatten(modules),
    x_length=x_length_3,
    y_length=y_length_3,
    z_length=z_length_3,
    edge_length=edge_length_4,
    cast=cast)  # -> out, bbox, concrete; inputs ice: list of Brep, x_length: Int32, y_length: Int32, z_length: Int32, cast: Boolean
# ---------- cast_2: Python ----------
##############################
####### import modules #######
##############################

# module from Rhino namespace
# https://developer.rhino3d.com/api/RhinoCommon/html/N_Rhino_Geometry.htm
import Rhino.Geometry as rg
# https://developer.rhino3d.com/api/RhinoCommon/html/T_Rhino_RhinoMath.htm
import Rhino.RhinoMath as rm



##############################
############ code ############
##############################

# set tolerance
distol = rm.DefaultDistanceToleranceMillimeters

# set x, y and z interval
x_itv = rg.Interval(0, (x_length-1)*edge_length)
y_itv = rg.Interval(0, (y_length-1)*edge_length)
z_itv = rg.Interval(0, (z_length-1)*edge_length)

# create a box
bbox = rg.Box(rg.Plane.WorldXY, x_itv, y_itv, z_itv)
bbox_brep = bbox.ToBrep()

# boolean difference
if cast:
    concrete = rg.Brep.CreateBooleanDifference([bbox_brep], ice, 10)
    print(concrete)
# ---------- end cast_2 ----------

list_2 = ValueList({"ice": 0, "concrete": 1}, selected="concrete")
dam_2 = DataDam(DataConcrete=cast_2.concrete, BufferDelay=10000000, BufferMode=0)
prefix = Panel("yy_mm_dd")

# ----
# Fabrication
prefix_2 = Text(prefix)
fab = GhPythonScript(prefix=prefix_2, module=dam, export=export)  # -> out, top, bot
# ---------- fab: Python ----------
##############################
####### import modules #######
##############################

# module from Rhino namespace
# https://developer.rhino3d.com/api/RhinoCommon/html/N_Rhino_Geometry.htm
import Rhino.Geometry as rg
# https://developer.rhino3d.com/api/RhinoCommon/html/T_Rhino_RhinoMath.htm
import Rhino.RhinoMath as rm

# os module to get path
# https://docs.python.org/3/library/os.html
import os

# compas module for export
# https://compas.dev/compas/latest/api/generated/compas.datastructures.Mesh.html
from compas.datastructures import Mesh

##############################
########## function ##########
##############################

# a function to get offset bounding box for fabrication
def get_bbox_fab(module, scale_factor):                                                  # name a function with arguments
    bbox = module.module_brep.GetBoundingBox(accurate=True)                              # get boundingbox
    S = rg.Transform.Scale(module.base_plane, scale_factor, scale_factor, scale_factor)  # calculate transformation matrix
    bbox.Transform(S)                                                                    # transform the bbox, scale
    return bbox.ToBrep()                                                                 # return the bbox in brep

# a function to get cutter brep for fabrication
def get_cutter(module):                                                           # name a function with argument
    d_interval_x = rg.Interval(module.interval_x.Mid - module.interval_x.Length,  # get a doubled interval_x
                               module.interval_x.Mid + module.interval_x.Length)  # 
    d_interval_y = rg.Interval(module.interval_x.Mid - module.interval_x.Length,  # get a doubled interval_y
                               module.interval_x.Mid + module.interval_x.Length)  #
    cutter = rg.PlaneSurface(module.base_plane, d_interval_x, d_interval_y)       # create a cutter as surface
    return cutter.ToBrep()                                                        # return the cutter in brep

# a function to create a triangulated mesh from brep
def meshing(brep_to_mesh):                               # name a function with an argument
    mparam = rg.MeshingParameters.Default                # set a meshing param
    mesh = rg.Mesh.CreateFromBrep(brep_to_mesh, mparam)  # create a mesh
    
    joined_mesh = rg.Mesh()                              # initiate a mesh
    for m in mesh:                                       # iterate through group of meshes
        joined_mesh.Append(m)                            # append the meshes into one mesh
    joined_mesh.Faces.ConvertQuadsToTriangles()          # triangulate the mesh
    joined_mesh.Weld(rm.DefaultAngleTolerance)           # weld the meshes
    return joined_mesh                                   # return the mesh

# a function to create a fabrication ready mesh
def module2fab(module, scale_factor=1.05):                                                                                        # name a functoin with arguments
    bbox_fab = get_bbox_fab(module, scale_factor)                                                                                 # get bbox for fab
    cutter = get_cutter(module)                                                                                                   # create a cutter
    bot, top = None, None                                                                                                         # set initial top and bot
    try:                                                                                                                          # try to...________________________________________________
        bot, top = rg.Brep.CreateBooleanSplit(bbox_fab, cutter, module.distol)                                                    #     split the bbox into half                             \
        try:                                                                                                                      #     try to...___________________________________          \
            top = rg.Brep.CreateBooleanDifference(top, module.module_brep, module.distol)[0]                                      #         subtract module from top                \          \
            bot = rg.Brep.CreateBooleanDifference(bot, module.module_brep, module.distol)[0]                                      #         subtract module from bottom              \          \
            try:                                                                                                                  #         try to..._______________________          \          \
                top = meshing(top)                                                                                                #             create a mesh for top       \          \          \
                bot = meshing(bot)                                                                                                #             create a mesh for bottom     \          \          \
                if top.IsClosed and bot.IsClosed:                                                                                 #             if both are closed...         } 3rd try  } 2nd try  } 1st try
                    export_property = 'meshes are ready to export'                                                                #                 set a export property    /          /          /
                else:                                                                                                             #             if one of meshes is open... /          /          /
                    export_property = 'meshing fail, \ntop is closed: {} \nbot is closed: {}'.format(top.IsClosed, bot.IsClosed)  #                 set a export property  /          /          /
            except:                                                                                                               #         except...                     /          /          /
                export_property = 'meshing fail, \ntop is {} \nbot is {}'.format(top, bot)                                        #             set a export property____/          /          /
        except:                                                                                                                   #     except...                                  /          /
            export_property = 'BooleanDifference fail, \ntop is {} \nbot is {}'.format(top, bot)                                  #         set a export property_________________/          /
    except:                                                                                                                       # except...                                               /
        export_property = 'CreateBooleanSplit fail, \nthe module is {}'.format(module)                                            #     set a export property______________________________/
    return top, bot, export_property                                                                                              # return top, bot and property

# a function to create a compas mesh from rhino mesh
def r2c_mesh(rhino_mesh):                                                                 # name a function with an argument
    compas_mesh = Mesh()                                                                  # initiate a compas mesh
    for v in rhino_mesh.Vertices:                                                         # iterate through the vertices
        compas_mesh.add_vertex(attr_dict=dict(x=float(v.X), y=float(v.Y), z=float(v.Z)))  #     set vertex
    for f in rhino_mesh.Faces:                                                            # iterate through the faces
        compas_mesh.add_face([f.A, f.B, f.C])                                             #     set faces
    return compas_mesh                                                                    # return the compas mesh

# a function to export a mesh
def export_mesh(r_mesh, prefix, name):                                                            # name a method with arguments
    ghDoc = ghenv.Component.OnPingDocument()                                                      # a module to get the path to this file
    HERE = ghDoc.FilePath                                                                         # path to this file
    filename = prefix + "_" + name + ".stl"                                                       # create a filename
    path = os.path.abspath(os.path.join(HERE, "..", "..", "..", "data", "sample_fab", filename))  # get a filepath
    c_mesh = r2c_mesh(r_mesh)                                                                     # transform rhino mesh into compas mesh
    c_mesh.to_stl(path)                                                                           # save the mesh as stl format
    return path                                                                                   # return the path

##############################
############ code ############
##############################

if module:                                                                   # if module is NOT None...
    top, bot, export_property = module2fab(module)                           #     create fabrication ready mesh
    if export and (export_property=='meshes are ready to export'):           #         if mesh is ready and button us pushed...
        try:                                                                 #             try to...
            path_top = export_mesh(top, prefix, "top")                       #                 export top
            path_bot = export_mesh(bot, prefix, "bot")                       #                 export bot
            export_property = "top is exported to \n{}".format(path_top)     #                 set export property for top
            export_property += "\nbot is exported to \n{}".format(path_bot)  #                 set export property for bot
        except:                                                              #             except...
            export_property = "export fail"                                  #                 set export property
else:                                                                        # if module is None...
    export_property = 'module is None'                                       #     set export property
print(export_property)                                                       # print export property to monitor
# ---------- end fab ----------

export_property = Panel(fab.out)
mesh = Mesh(fab.top)
mesh_2 = Mesh(fab.bot)

filter = StreamFilter(Gate=list_2, Stream0=modules, Stream1=dam_2)
filter_2 = StreamFilter(Gate=list_2, Stream0=ColourSwatch(SwatchColor=RGB(171, 196, 201)), Stream1=ColourSwatch(SwatchColor=RGB(148, 148, 148)))

bake = GhPythonScript(geo_to_bake=filter, material=filter_2, material_type=list_2, prefix=prefix, bake=Button())  # inputs geo_to_bake: list of Brep
# ---------- bake: Python ----------
##############################
####### import modules #######
##############################

# module from Rhino namespace
# https://developer.rhino3d.com/api/RhinoCommon/html/N_Rhino_Geometry.htm
import Rhino.Geometry as rg
# https://developer.rhino3d.com/api/RhinoCommon/html/N_Rhino_DocObjects.htm
import Rhino.DocObjects as rd
# https://developer.rhino3d.com/api/RhinoCommon/html/T_Rhino_RhinoDoc.htm
import Rhino.RhinoDoc as rrd

# what is scriptcontext...? The library is here in my case
# C:\Users\trtku\AppData\Roaming\McNeel\Rhinoceros\7.0\Plug-ins\IronPython\settings\lib
import scriptcontext as sc

# accessing graphic libraries
# https://docs.microsoft.com/en-us/dotnet/api/system.drawing?view=net-6.0
import System.Drawing as sd



##############################
############ code ############
##############################

# get an active document
# https://developer.rhino3d.com/api/RhinoCommon/html/P_Rhino_RhinoDoc_ActiveDoc.htm
sc.doc = rrd.ActiveDoc

# bake if the button is pushed...
if bake:
    
    # iterate through the list of geometries to be baked
    for i, geo in enumerate(geo_to_bake):
        
        # initiate ObjectAttribute class
        attr = rd.ObjectAttributes()
        
        # set attributes for color
        attr.ColorSource = rd.ObjectColorSource.ColorFromObject
        attr.ObjectColor = sd.Color.FromArgb(material.A, material.R, material.G, material.B)
        
        # create layer names with prefix
        if material_type==0:
            mat = 'ice'
        else:
            mat = 'concrete'
        layer_name = prefix + '_' + mat
        
        # get a layer index for the layername
        layer_index = sc.doc.Layers.Find(layer_name, True)
        # if there is no existing layer...
        if layer_index < 0:
            # initiate layer object
            layer = rd.Layer()
            # set layer name
            layer.Name = layer_name
            # create a new layer
            layer_index = sc.doc.Layers.Add(layer)
        
        # set an attribute for layer
        attr.LayerIndex = layer_index
        
        # check if the geometry is brep class
        if type(geo)==rg.Brep:
            # bake geometry with attributes
            sc.doc.Objects.AddBrep(geo, attr)
            # print a message
            print('the geometry is successfully baked')
        
        # print a message if type is NOT brep
        else:
            # print a message
            print('{}th geometry type is NOT brep'.format(i))
# ---------- end bake ----------
preview_3 = CustomPreview(Geometry=cast_2.bbox, Material=ColourSwatch(SwatchColor=RGBA(201, 171, 171, 50)))
preview_4 = CustomPreview(Geometry=filter, Material=filter_2)
